# Grasshopper definition SmallPasteScrew.gh (Grasshopper 1.0.4)
# plug-ins: Weaverbird, DendroGH

vsettings = CreateSettings(
    VoxelSize=Slider(0.15, range=0..1),
    Bandwidth=1,
    Isovalue=Slider(0.01, range=0..0.01),
    Adaptivity=Slider(0.1, range=0..1))
vsettings_2 = VolumeSettings(vsettings)

number_slider = Slider(3, range=0..10)
crv = Curve([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])
bbox = BoundingBox(Content=crv, Plane=PlaneXY(0, 0, 0), UnionBox=True)  # -> Box, Box_2
arrbox = BoxArray(Geometry=crv, Cell=bbox.Box, XCount=number_slider, YCount=number_slider, ZCount=number_slider)  # -> Geometry, Transform
divide = DivideCurve(Curve=arrbox.Geometry, Count=100, Kinks=False)  # -> flatten(Points), Tangents, Parameters
pt = Point(Point(-28.34181773, -30.23517135, 70.53868588))
brep = Brep(<brep referenced from the Rhino model>)
lng = ListLength(List=divide.Points)
brep_2 = Brep(<brep referenced from the Rhino model>)
mesh = MeshBrep(
    Brep=brep,
    Settings={GridMaxCount=0, GridMinCount=16, JaggedSeams=False, MaxEdgeLength=0, MinEdgeLength=0.0001, MinTolerance=0, Refine=True, RefineAngle=0, RelativeTolerance=0.65, SimplePlanes=True, Tolerance=0})
mesh_2 = MeshBrep(
    Brep=brep_2,
    Settings={GridMaxCount=0, GridMinCount=16, JaggedSeams=False, MaxEdgeLength=0, MinEdgeLength=0.0001, MinTolerance=0, Refine=True, RefineAngle=0, RelativeTolerance=0.65, SimplePlanes=True, Tolerance=0})
subtraction = Subtraction(A=lng, B=1)
dist = Distance(PointA=pt, PointB=divide.Points)
dots = DotDisplay(Point=pt, Colour=RGB(255, 0, 0), Size=0.5)
dom = ConstructDomain(DomainStart=Slider(0.6, range=0..2), DomainEnd=Slider(1.5, range=0..2))
range = Range(Domain=dom, Steps=subtraction)
sort = SortList(Keys=dist, ValuesA=divide.Points)  # -> Keys, ValuesA
vsettings_3 = VolumeSettings(vsettings_2)
vmesh = MeshToVolume(Mesh=mesh, Settings=vsettings_3)
vmesh_2 = MeshToVolume(Mesh=mesh_2, Settings=vsettings_3)
vpoints = PointsToVolume(Points=sort.ValuesA, PointRadius=range, Settings=vsettings_3)  # disabled
vunion = VolumeUnion(Volumes=[vmesh_2, vmesh])
vsmooth = SmoothVolume(Volume=vunion, Width=1, Type=2, Iterations=1)
vsettings_4 = VolumeSettings(vsettings_2)
number_slider_2 = Slider(2, range=0..10)
mvolume = VolumeToMesh(Volume=vunion, VolumeSettings=vsettings_4)
wbblur = WeaverbirdsBlurMesh(MeshCurves=mvolume, Level=number_slider_2, Thin=1)
wblaplace = WeaverbirdsLaplacianSmoothing(MeshCurves=mvolume, Level=number_slider_2, SmoothNakedEdges=1, Thin=1)
preview = CustomPreview(
    Geometry=wblaplace,
    Material={diffuse=RGB(81, 135, 237), emission=RGB(0, 0, 0), shine=0, specular=RGB(138, 138, 76), transparency=0})
