# Grasshopper definition PerilstaticPumpParametric.gh (Grasshopper 1.0.4)
# Copyright: CreativeCommons ShareALikeNotComercial

leftover_distance_for_the_pipe = Slider(2, range=0..10)
outer_size_of_bearing = Slider(14, range=0..100)
thickness_ofbase = Slider(8, range=0..10)
outer_size_of_bearing_2 = Slider(5, range=0..100)
height_size_of_bearing = Slider(5, range=0..100)
thickness_of_bearing_holder = Slider(7, range=0..10)
pipe_diameter = Slider(6, range=0..10)
pipe_diameter_2 = Slider(8, range=0..10)
coverheight = Slider(2, range=0..10)
pipe_position = Slider(4, range=0..10)
shaft_stepper = Slider(5.1, range=0..10)
lenght_shaft_stepper = Slider(8, range=0..10)
offset_shaft_stepper = Slider(2.8, range=0..10)
position_exit_pipes = Slider(19, range=0..100)
headofscrewdiameter = Slider(6, range=0..100)
holes_distance_stepper = Slider(31, range=0..100)
holes_diameter_stepper = Slider(3.1, range=0..10)
headofscrewheight = Slider(6, range=0..100)
outer_size_stepper = Slider(55, range=0..100)
rectangle = Rectangle(Plane=PlaneXY(0, 0, 0), XSize=outer_size_stepper, YSize=outer_size_stepper, Radius=Slider(5, range=0..10))  # -> Rectangle, Length
rectangle_2 = Rectangle(Plane=PlaneXY(0, 0, 0), XSize=holes_distance_stepper, YSize=holes_distance_stepper, Radius=0)  # -> Rectangle, Length
area = Area(Geometry=rectangle.Rectangle)  # -> Area, Centroid
disc = Discontinuity(Curve=rectangle_2.Rectangle, Level=1)  # -> Points, Parameters
bbox = BoundingBox(Content=rectangle_2.Rectangle, Plane=PlaneXY(0, 0, 0), UnionBox=True)  # -> Box, Box_2
expression = Expression(x=holes_diameter_stepper, Expression="x/2")
area_2 = Area(Geometry=bbox.Box)  # -> Area, Centroid
vec2pt = Vector2Pt(PointA=area_2.Centroid, PointB=area.Centroid, Unitize=False)  # -> Vector, Length
rectangle_3 = Rectangle(Plane=PlaneXY(0, 0, 0), XSize=outer_size_stepper, YSize=outer_size_stepper, Radius=0)  # -> Rectangle, Length
cir = Circle(Plane=disc.Points, Radius=expression)
neg = Negative(Value=Slider(3.2, range=0..10))
move = Move(Geometry=cir, Motion=vec2pt.Vector)  # -> Geometry, Transform
Z = UnitZ(Factor=outer_size_stepper)
offset = OffsetCurve(Curve=rectangle_3.Rectangle, Distance=neg, Plane=PlaneXY(0, 0, 0), Corners=1)
pt = Point(area.Centroid)

expression_2 = Expression(x=shaft_stepper, Expression="x/2")
cir_2 = Circle(Plane=pt, Radius=expression_2)
Z_2 = UnitZ(Factor=lenght_shaft_stepper)
offset_2 = OffsetCurve(Curve=cir_2, Distance=offset_shaft_stepper, Plane=PlaneXY(0, 0, 0), Corners=1)
boundary = BoundarySurfaces(Edges=flatten([cir_2, offset_2]))
extr = Extrude(Base=boundary, Direction=Z_2)

divide = DivideCurve(Curve=cir_2, Count=10, Kinks=False)  # -> Points, Tangents, Parameters
item = ListItem(List=divide.Points, Index=0, Wrap=True)
box = CenterBox(Base=item, X=Slider(0.5, range=0..1), Y=expression_2, Z=lenght_shaft_stepper)
neg_2 = Negative(Value=Z)
area_3 = Area(Geometry=move.Geometry)  # -> Area, Centroid
boundary_2 = BoundarySurfaces(Edges=move.Geometry)
number_slider = Slider(13, range=0..100)
expression_3 = Expression(x=headofscrewdiameter, Expression="x/2")
number_slider_2 = Slider(3, range=0..10)
disc_2 = Discontinuity(Curve=offset, Level=1)  # -> Points, Parameters
extr_2 = Extrude(Base=graft(boundary_2), Direction=[Z, neg_2])  # -> flatten(Extrusion)
cir_3 = Circle(Plane=area_3.Centroid, Radius=expression_3)
Z_3 = UnitZ(Factor=headofscrewheight)
Z_4 = UnitZ(Factor=outer_size_stepper)
cir_4 = Circle(Plane=disc_2.Points, Radius=expression)
boundary_3 = BoundarySurfaces(Edges=cir_3)
neg_3 = Negative(Value=Z_3)
neg_4 = Negative(Value=Z_4)
boundary_4 = BoundarySurfaces(Edges=cir_4)
polygon = Polygon(Plane=pt, Radius=number_slider, Segments=number_slider_2, FilletRadius=0)  # -> Polygon, Length
extr_3 = Extrude(Base=graft(boundary_3), Direction=neg_3)  # -> flatten(Extrusion)
extr_4 = Extrude(Base=graft(boundary_4), Direction=[neg_4, Z_4])  # -> flatten(Extrusion)
cir_5 = Circle(Plane=pt, Radius=position_exit_pipes)
disc_3 = Discontinuity(Curve=polygon.Polygon, Level=1)  # -> Points, Parameters

expression_4 = Expression(x=outer_size_of_bearing, Expression="x/2")
expression_5 = Expression(x=outer_size_of_bearing_2, Expression="x/2")
cir_6 = Circle(Plane=disc_3.Points, Radius=expression_5)
cir_7 = Circle(Plane=disc_3.Points, Radius=expression_4)
Z_5 = UnitZ(Factor=height_size_of_bearing)
boundary_5 = BoundarySurfaces(Edges=[cir_7, cir_6])
extr_5 = Extrude(Base=boundary_5, Direction=Z_5)

divide_2 = DivideCurve(Curve=cir_5, Count="2", Kinks=False)  # -> Points, Tangents, Parameters
addition = Addition(A=number_slider, B=outer_size_of_bearing)
Z_6 = UnitZ(Factor=pipe_diameter_2)
Z_7 = UnitZ(Factor=pipe_position)
polygon_2 = Polygon(Plane=pt, Radius=addition, Segments=number_slider_2, FilletRadius=expression_4)  # -> Polygon, Length; disabled
move_2 = Move(Geometry=divide_2.Points, Motion=Z_7)  # -> Geometry, Transform
expression_6 = Expression(x=pipe_diameter, Expression="x/2")
Z_8 = UnitZ(Factor=thickness_ofbase)
addition_2 = Addition(A=number_slider, B=expression_4)
cir_8 = Circle(Plane=pt, Radius=addition_2)
offset_3 = OffsetCurve(Curve=cir_8, Distance=leftover_distance_for_the_pipe, Plane=PlaneXY(0, 0, 0), Corners=1)
merge = Merge(Data1=rectangle.Rectangle, Data2=offset_3)
merge_2 = Merge(Data1=rectangle.Rectangle, Data2=cir_8)
neg_5 = Negative(Value=expression_6)
boundary_6 = BoundarySurfaces(Edges=flatten(merge))
xz = XZPlane(Origin=move_2.Geometry)
boundary_7 = BoundarySurfaces(Edges=flatten(merge_2))
neg_6 = Negative(Value=Z_8)
cir_9 = Circle(Plane=xz, Radius=expression_6)
dom = ConstructDomain(DomainStart=neg_5, DomainEnd=expression_6)
dom_2 = ConstructDomain(DomainStart="0", DomainEnd=pipe_diameter_2)
subtraction = Subtraction(A=addition_2, B="1.5")
extr_6 = Extrude(Base=boundary_7, Direction=neg_6)
move_3 = Move(Geometry=boundary_7, Motion=Z_6)  # -> Geometry, Transform
Z_9 = UnitZ(Factor=coverheight)
sdiff = SolidDifference(BrepsA=extr_6, BrepsB=extr_3)
cir_10 = Circle(Plane=pt, Radius=subtraction)
merge_3 = Merge(Data1=cir_6, Data2=cir_10, Data3=cir_2)  # -> flatten(Result)
boundary_8 = BoundarySurfaces(Edges=merge_3)
Z_10 = UnitZ(Factor=thickness_of_bearing_holder)
rectangle_4 = Rectangle(Plane=xz, XSize=dom, YSize=dom_2, Radius=0)  # -> Rectangle, Length
neg_7 = Negative(Value=Z_10)
extr_7 = Extrude(Base=move_3.Geometry, Direction=Z_9)
sdiff_2 = SolidDifference(BrepsA=sdiff, BrepsB=extr_2)
extr_8 = Extrude(Base=boundary_6, Direction=Z_6)
runion = RegionUnion(Curves=[rectangle_4.Rectangle, cir_9])
extr_9 = Extrude(Base=boundary_8, Direction=neg_7)
Y = UnitY(Factor=outer_size_stepper)
boundary_9 = BoundarySurfaces(Edges=flatten(runion))
merge_4 = Merge(Data1=extr, Data2=extr_9, Data3=box)  # -> flatten(Result)
sdiff_3 = SolidDifference(BrepsA=extr_8, BrepsB=extr_4)
sdiff_4 = SolidDifference(BrepsA=extr_7, BrepsB=extr_4)
sdiff_5 = SolidDifference(BrepsA=sdiff_2, BrepsB=extr_4)
extr_10 = Extrude(Base=boundary_9, Direction=Y)  # -> flatten(Extrusion)
sunion = SolidUnion(Breps=merge_4)
rotate = Rotate(Geometry=extr_5, Angle=degrees(Slider(50, range=0..360)), Plane=pt)  # -> Geometry, Transform
preview = CustomPreview(
    Geometry=rotate.Geometry,
    Material={diffuse=RGB(221, 160, 221), emission=RGB(66, 48, 66), shine=0.5, specular=RGB(255, 255, 255), transparency=0})
