# Grasshopper definition TOOL-SyringePasteExtruder.gh (Grasshopper 1.0.4)
# plug-ins: Pufferfish

motor_placement = Slider(32, range=0..100)
gearreducingfactor = Slider(25.5, range=0..100)
shaft_diametersstepper = Slider(5, range=0..15)
offset_of_shaft = Slider(2, range=0..10)
number_slider = Slider(8, range=0..20)
shaftscrewdiameter = Slider(3.5, range=0..10)
screw_shaft_position = Slider(0.75, range=0..2)
circular_shaft_multiplier = Slider(2, range=0..10)
number_slider_2 = Slider(0, range=0..1000)
zposition = Slider(15, range=0..200)
thickness_base = Slider(10, range=0..20)
offset_of_curve = Slider(7, range=0..100)
holes_positions = Slider(90, range=0..100)
hole_poisition = Slider(100, range=0..220)

# ---- group: motor
bearing_outer_diameter = Slider(23.2, range=0..100)
motor_connection = Slider(50, range=0..100)
coupler_height = Slider(7, range=0..100)
motormount_size = Slider(3, range=0..100)
holemotor_size = Slider(23, range=0..100)
outermotor_size = Slider(43, range=0..100)
motor_holes_distance = Slider(31, range=0..100)

# ----
hole_distance_on_radius = BooleanToggle(False)
motor_connection_2 = Slider(50, range=0..100)
number_slider_3 = Slider(21, range=0..100)
pt = ConstructPoint(XCoordinate=0, YCoordinate=0, ZCoordinate=0)
cir = Circle(Plane=PlaneXY(0, 0, 0), Radius=holes_positions)
pt_2 = Point(pt)
expression = Expression(x=bearing_outer_diameter, Expression="x/2")
expression_2 = Expression(x=motor_holes_distance, Expression="x/2")
rotate = Rotate(Geometry=cir, Angle=degrees("45"), Plane=PlaneXY(0, 0, 0))  # -> Geometry, Transform
# DOUBLE PLATTING
neg = Negative(Value=offset_of_curve)
Z = UnitZ(Factor=coupler_height)
number_slider_4 = Slider(15, range=0..20)
cir_2 = Circle(Plane=PlaneXY(0, 0, 0), Radius=expression)
X = UnitX(Factor=hole_poisition)
divide = DivideCurve(Curve=rotate.Geometry, Count="8", Kinks=False)  # -> Points, Tangents, Parameters
expression_3 = Expression(x=outermotor_size, Expression="x/2")
expression_4 = Expression(x=motor_connection_2, Expression="x/2")
expression_5 = Expression(x=motor_holes_distance, Expression="x/2")
expression_6 = Expression(x=motormount_size, Expression="x/2")
# MOTOR CHARACTERISTICS
extr = Extrude(Base=cir_2, Direction=Z)
addition = Addition(A=gearreducingfactor, B="15")
expression_7 = Expression(x=holemotor_size, Expression="x/2")
X_2 = UnitX(Factor=motor_placement)
neg_2 = Negative(Value=expression_5)
move = Move(Motion=X)  # -> Geometry, Transform
neg_3 = Negative(Value=expression_3)
neg_4 = Negative(Value=motor_connection)
cap = CapHoles(Brep=extr)
cir_3 = Circle(Plane=PlaneXY(0, 0, 0), Radius=addition)
# EXTRUDER POINT
# List of common combinations
# of nominal diameter and pitch:
# 
# M Nominal Diameter x Pitch (mm)
# fixing plate
offset = OffsetCurve(Curve=cir_3, Distance=neg, Plane=PlaneXY(0, 0, 0), Corners=1)
pull = PullPoint(Point=divide.Points, Geometry=offset, ClosestOnly=True)  # -> ClosestPoint, Distance
cir_4 = Circle(Plane=pull.ClosestPoint, Radius=expression_6)
move_2 = Move(Geometry=pt_2, Motion=X_2)  # -> Geometry, Transform
cir_5 = Circle(Plane=move_2.Geometry, Radius=expression_2)
area = Area(Geometry=cir_5)  # -> Area, Centroid
dom = ConstructDomain(DomainStart=expression_5, DomainEnd=neg_2)
arrpolar = PolarArray(Geometry=cir_4, Plane=PlaneXY(0, 0, 0), Count=Slider(4, range=0..10), Angle=6.283185307)  # -> Geometry, Transform
dom_2 = ConstructDomain(DomainStart=expression_3, DomainEnd=neg_3)
dom_3 = ConstructDomain(DomainStart=expression_4, DomainEnd=neg_4)
rotate_2 = Rotate(Geometry=cir_5, Angle=degrees("45"), Plane=area.Centroid)  # -> Geometry, Transform
rectangle = Rectangle(Plane=move_2.Geometry, XSize=dom, YSize=dom, Radius=0)  # -> Rectangle, Length
cir_6 = Circle(Plane=move_2.Geometry, Radius=expression_7)
rectangle_2 = Rectangle(Plane=move_2.Geometry, XSize=dom_3, YSize=dom_2, Radius="5")  # -> Rectangle, Length
crv = Curve(rectangle_2.Rectangle)
merge = Merge(Data1=cir_3, Data2=crv)
runion = RegionUnion(Curves=merge)
cir_7 = Circle(Plane=move.Geometry, Radius=expression_6)
disc = Discontinuity(Curve=rectangle.Rectangle, Level=1)  # -> Points, Parameters
divide_2 = DivideCurve(Curve=rotate_2.Geometry, Count="4", Kinks=False)  # -> Points, Tangents, Parameters
merge_2 = Merge(Data1=arrpolar.Geometry, Data2=cir_7)  # -> flatten(Result)
fillet = Fillet(Curve=runion, Radius=Slider(20, range=0..20))
filter = StreamFilter(Gate=hole_distance_on_radius, Stream0=disc.Points, Stream1=divide_2.Points)
cir_8 = Circle(Plane=filter, Radius=expression_6)
boundary = BoundarySurfaces(Edges=flatten(merge_2))
boundary_2 = BoundarySurfaces(Edges=flatten(fillet))
boundary_3 = BoundarySurfaces(Edges=flatten(rectangle_2.Rectangle))
merge_3 = Merge(Data1=cir_6, Data2=cir_8)  # -> flatten(Result)
Z_2 = UnitZ(Factor=thickness_base)
Z_3 = UnitZ(Factor=thickness_base)
Z_4 = UnitZ(Factor=thickness_base)
extr_2 = Extrude(Base=boundary_3, Direction=Z_2)
Z_5 = UnitZ(Factor=thickness_base)
extr_3 = Extrude(Base=boundary_2, Direction=Z_4)
extr_4 = Extrude(Base=merge_3, Direction=Z_3)
extr_5 = Extrude(Base=boundary, Direction=Z_5)
cap_2 = CapHoles(Brep=extr_4)
merge_4 = Merge(Data1=extr_5, Data2=cap_2, Data5=cap)  # -> flatten(Result)
merge_5 = Merge(Data1=extr_2, Data2=extr_3)
merge_6 = Merge(Data1=extr_5, Data2=cap_2, Data4=cap)
sunion = SolidUnion(Breps=merge_4)  # disabled
sunion_2 = SolidUnion(Breps=flatten(merge_5))  # disabled
sunion_3 = SolidUnion(Breps=flatten(merge_6))  # disabled
number_slider_5 = Slider(1, range=0..10)
number_slider_6 = Slider(2, range=0..10)
sdiff = SolidDifference(BrepsA=sunion_2, BrepsB=sunion_3)
multiplication = Multiplication(A=number_slider_5, B=thickness_base)
num = Number(coupler_height)
scale_nu = ScaleNU(Geometry=sdiff, Plane=PlaneXY(0, 0, 0), ScaleX=1, ScaleY=1, ScaleZ=number_slider_5)  # -> Geometry, Transform
subtraction = Subtraction(A=multiplication, B=num)
neg_5 = Negative(Value=Slider(50, range=0..100))
Z_6 = UnitZ(Factor=neg_5)
pt_3 = ConstructPoint(XCoordinate=number_slider_2, YCoordinate=0, ZCoordinate=neg_5)
cir_9 = Circle(Plane=pt_3, Radius=expression)
move_3 = Move(Geometry=scale_nu.Geometry, Motion=Z_6)  # -> Geometry, Transform
Z_7 = UnitZ(Factor=subtraction)
boundary_4 = BoundarySurfaces(Edges=cir_9)
extr_6 = Extrude(Base=boundary_4, Direction=Z_7)  # disabled
sunion_4 = SolidUnion(Breps=[move_3.Geometry, extr_6])
cir_10 = Circle(Plane=pt_3, Radius=1)
boundary_5 = BoundarySurfaces(Edges=cir_10)
Z_8 = UnitZ(Factor=multiplication)
extr_7 = Extrude(Base=boundary_5, Direction=Z_8)
sdiff_2 = SolidDifference(BrepsA=sunion_4, BrepsB=extr_7)
sdiff_3 = SolidDifference(BrepsB=sunion)

num_2 = Number(motor_placement)
num_3 = Number(number_slider_2)
neg_6 = Negative(Value=zposition)
expression_8 = Expression(x=shaft_diametersstepper, Expression="x/2")
X_3 = UnitX(Factor=num_2)
pt_4 = ConstructPoint(XCoordinate=num_3, YCoordinate=0, ZCoordinate=neg_6)
subtraction_2 = Subtraction(A=num_2, B=gearreducingfactor)
cir_11 = Circle(Plane=pt_4, Radius=gearreducingfactor)
Z_9 = UnitZ(Factor=number_slider)
move_4 = Move(Geometry=pt_4, Motion=Z_9)  # -> Geometry, Transform
number_slider_7 = Slider(8, range=0..10)
addition_2 = Addition(A=Slider(10, range=0..10), B=number_slider_7)
Z_10 = UnitZ(Factor=number_slider)
cir_12 = Circle(Plane=move_4.Geometry, Radius=addition_2)
cir_13 = Circle(Plane=pt_4, Radius=Slider(4.5, range=0..10))
polygon = Polygon(Plane=move_4.Geometry, Radius=number_slider_7, Segments=Slider(6, range=0..10), FilletRadius=0)  # -> Polygon, Length
boundary_6 = BoundarySurfaces(Edges=[polygon.Polygon, cir_12])
Z_11 = UnitZ(Factor=Slider(7, range=0..100))
panel = Panel("2")
extr_8 = Extrude(Base=flatten(boundary_6), Direction=Z_11)
multiplication_2 = Multiplication(A=number_slider, B=circular_shaft_multiplier)
Z_12 = UnitZ(Factor=multiplication_2)
Z_13 = UnitZ(Factor=Z_12)
multiplication_3 = Multiplication(A=Z_12, B=screw_shaft_position)
expression_9 = Expression(x=shaftscrewdiameter, Expression="x/2")
X_4 = UnitX(Factor=shaft_diametersstepper)

Y = UnitY(Factor=num_2)

move_5 = Move(Geometry=pt_4, Motion=Y)  # -> Geometry, Transform
cir_14 = Circle(Plane=move_5.Geometry, Radius=subtraction_2)
geo = Geometry([cir_11, cir_14])
gear_2d = Gears(
    A=geo,
    y=Slider(11, range=0..100),
    p=Slider(22.5, range=14.5..22.5),
    A_2=Slider(1.1, range=1..1.25),
    A_3=Slider(1.25, range=1.25..1.3))  # -> C, L, B, W
linedim = LineDimension(Line=gear_2d.W, Text="{0:0.00}", Size=1)
bang = ExplodeTree(Data=gear_2d.B)  # -> Branch0, Branch1
cir_15 = Circle(Plane=bang.Branch0, Radius=expression_8)
boundary_7 = BoundarySurfaces(Edges=gear_2d.C)
extr_9 = Extrude(Base=flatten(boundary_7), Direction=Z_10)
boundary_8 = BoundarySurfaces(Edges=[cir_15, cir_13])
offcrv = OffsetCurve(Curve=cir_15, Distance=offset_of_shaft, Plane=PlaneXY(0, 0, 0), BothSides=False, Kinks=0, CapType=1)
extr_10 = Extrude(Base=flatten(boundary_8), Direction=Z_13)
boundary_9 = BoundarySurfaces(Edges=offcrv)
eval = EvaluateCurve(Curve=reparameterize(offcrv), Parameter=Slider(0.5, range=0..1))  # -> Point, Tangent, Angle
extr_11 = Extrude(Base=flatten(boundary_9), Direction=Z_12)
merge_7 = Merge(Data1=extr_10)
move_6 = Move(Geometry=eval.Point, Motion=multiplication_3)  # -> Geometry, Transform
entwine = Entwine(Branch00=extr_11, Branch01=extr_8, FlattenInputs=True)  # -> simplify(Result)
yz = YZPlane(Origin=move_6.Geometry)
merge_8 = Merge(Data1=simplify(graft(extr_9)), Data2=entwine)
cir_16 = Circle(Plane=yz, Radius=expression_9)
extr_12 = Extrude(Base=flatten(cir_16), Direction=X_4)
sunion_5 = SolidUnion(Breps=merge_8)
cap_3 = CapHoles(Brep=extr_12)
merge_9 = Merge(Data1=merge_7, Data2=cap_3)  # -> flatten(Result)
sunion_6 = SolidUnion(Breps=merge_9)
sdiff_4 = SolidDifference(BrepsA=flatten(sunion_5), BrepsB=sunion_6)
item = ListItem(List=sdiff_4, Index=0, Wrap=True)  # -> Item, Item1
bbox = BoundingBox(Content=item.Item1, Plane=PlaneXY(0, 0, 0))  # -> Box, Box_2

panel_2 = Panel(gear_2d.L)
box = CenterBox(Base=move_5.Geometry, X=number_slider_3, Y=number_slider_3, Z=Slider(50, range=0..100))
# GEAR BOX
wires = BrepWireframe(Brep=box, Density=-1)
debox = DeconstructBox(Box=bbox.Box)  # -> Plane, X, Y, Z
boxprop = BoxProperties(Box=bbox.Box)  # -> Center, Diagonal, Area, Volume, Degeneracy
dedomain = DeconstructDomain(Domain=debox.X)  # -> Start, End
subtraction_3 = Subtraction(A=dedomain.End, B=dedomain.Start)

panel_3 = Panel(subtraction_3)

geo_2 = Geometry(sdiff_4)
merge_10 = Merge(Data6=sdiff_3, Data7=geo_2, Data8=sdiff_2)
preview = CustomPreview(Geometry=merge_10, Material=ColourSwatch(SwatchColor=RGBA(153, 153, 153, 163)))

# ==== cluster Gears: Creat 2D Gears
A = ClusterInput()
y = ClusterInput()
p = ClusterInput()
A_2 = ClusterInput()
A_3 = ClusterInput()
lng = ListLength(List=A)  # -> expr("x-1", Length)
darc = DeconstructArc(Arc=A)  # -> BasePlane, Radius, Angle
expression = Expression(x=lng, Expression="if(x = 0, 0 ,1)")
expression_2 = Expression(x=lng, Expression="if(x = 0, 1 ,x)")
range = Range(Domain=lng, Steps=lng)
sort = SortList(Keys=darc.Radius, ValuesA=A)  # -> Keys, ValuesA
sort_2 = SortList(Keys=darc.Radius)  # -> Keys, ValuesA
darc_2 = DeconstructArc(Arc=sort.ValuesA)  # -> BasePlane, Radius, Angle
item = ListItem(List=sort.Keys, Index=0, Wrap=True)
filter = StreamFilter(Gate=expression, Stream0=expression_2, Stream1=range)
moudule = Evaluate(F="(x*2)/y", x=item, y=y)
eval = Evaluate(F="(x*2)/y", x=darc_2.Radius, y=moudule)
item_2 = ListItem(List=sort.ValuesA, Index=filter, Wrap=True)  # -> graft(Item)
item_3 = ListItem(List=eval, Index=filter, Wrap=True)  # -> graft(Item)
eval_2 = Evaluate(F="(x)*m", x=A_2, m=moudule)
eval_3 = Evaluate(F="(x)*m", x=A_2, m=moudule)
darc_3 = DeconstructArc(Arc=item_2)  # -> BasePlane, Radius, Angle
python = PythonScript(c=item_2, x=eval_2, y=eval_3, p=p)  # -> out, simplify(a), b, simplify(c), d
# ---------- python: Python ----------
import Rhino as rh
import Rhino.Geometry as rg
import math as m
import Grasshopper as gh


"""place a new circle"""
def newCir(c,ag,x):
    
    addR = x
    
    
    """Trigonmetry of bevel gear"""
    cirPl = rg.Circle.Plane.GetValue(c)
    cirOr = cirPl.Origin
    cirZ = cirPl.ZAxis
    cirR = rg.Circle.Radius.GetValue(c)
    
    r = cirR + addR
    
    
    
    return rg.Circle(cirPl,r), r


a ,b = newCir(c,d,x)
c, d = newCir(c,d,-y)
print a
# ---------- end python ----------
involute = PythonScript(r=darc_3.Radius, p=p)  # -> b
# ---------- involute: Python ----------
import math
import Rhino as rh

c = 0.019
t=0
ptList = []
a = math.cos(math.radians(p))*r
for i in range(0,50):
    t += c
    x = a * (math.cos(t) + t * math.sin(t))
    y = a * (math.sin(t) - t * math.cos(t))
    z = 0
    pts = rh.Geometry.Point3d(x,y,z)
    ptList.append(pts)

b = rh.Geometry.PolylineCurve.CreateInterpolatedCurve(ptList,3)
# ---------- end involute ----------
range_2 = Range(Domain="360", Steps=item_3)
orient = Orient(Geometry=involute, Source=PlaneXY(0, 0, 0), Target=darc_3.BasePlane)  # -> Geometry, Transform
multiplication = Multiplication(A=A_2, B="10")
multiplication_2 = Multiplication(A=A_3, B="10")
lng_2 = ListLength(List=range_2)
ext = ExtendCurve(Curve=orient.Geometry, Type=0, Start=multiplication, End=multiplication_2)
split = SplitList(List=range_2, Index=expr("x-1", lng_2))  # -> ListA, ListB
divide = DivideCurve(Curve=item_2, Count=expr("x-1", lng_2), Kinks=False)  # -> Points, Tangents, Parameters
item_4 = ListItem(List=divide.Parameters, Index=0, Wrap=True)  # -> Item, Item1
data = Data(darc_3.BasePlane)
mcx = MultipleCurves(Curves=[item_2, ext])  # -> Points, IndexA, IndexB, ParamA, ParamB
eval_4 = Evaluate(F="(x+y)/4", x=item_4.Item, y=item_4.Item1)
addition = Addition(A=mcx.ParamA, B=eval_4)
eval_5 = EvaluateCurve(Curve=item_2, Parameter=addition)  # -> Point, Tangent, Angle
trim = TrimWithRegions(Curve=ext, Regions=[python.a, python.c])  # -> Inside, Outside
move = Move(Geometry=data, Motion=data)  # -> Geometry, Transform
ln = Line(StartPoint=move.Geometry, EndPoint=data)
item_5 = ListItem(List=trim.Inside, Index=1, Wrap=True)  # -> simplify(Item)
lnpt = LinePt(Line=ln, Point=eval_5.Point)
mirror = Mirror(Geometry=item_5, Plane=lnpt)  # -> simplify(Geometry), Transform
rotate = Rotate(Geometry=item_5, Angle=degrees(split.ListA), Plane=data)  # -> simplify(Geometry), Transform
rotate_2 = Rotate(Geometry=mirror.Geometry, Angle=degrees(split.ListA), Plane=data)  # -> simplify(Geometry), Transform
lng_3 = ListLength(List=rotate.Geometry)
weave = Weave(Pattern=[0, 1], Stream0=rotate.Geometry, Stream1=rotate_2.Geometry, NullGaps=False)
cluster = Cluster(data_2=python.a, data=python.c, R_2=python.b, R=python.d, C=weave, G=ln)  # -> G_2, G_3
item_6 = ListItem(List=cluster.G_2, Index=0, Wrap=True)
end = EndPoints(Curve=item_6)  # -> Start, End
end_2 = EndPoints(Curve=mirror.Geometry)  # -> Start, End
rotate_3 = Rotate(Geometry=cluster.G_2, Angle=degrees(split.ListA), Plane=data)  # -> simplify(Geometry), Transform
rotate_4 = Rotate(Geometry=cluster.G_3, Angle=degrees(split.ListA), Plane=data)  # -> simplify(Geometry), Transform
ln_2 = Line(StartPoint=end.Start, EndPoint=end.End)  # -> flatten(Line)
ln_3 = Line(StartPoint=end_2.Start, EndPoint=end_2.End)  # -> flatten(Line)
join = JoinCurves(Curves=[weave, rotate_3.Geometry, rotate_4.Geometry], Preserve=False)  # -> simplify(Curves)
weave_2 = Weave(Pattern=[0, 1], Stream0=ln_2, Stream1=ln_3, NullGaps=False)
B = ClusterOutput(darc_3.BasePlane)
W = ClusterOutput(weave_2)
C = ClusterOutput(join)
L = ClusterOutput(lng_3)

# ==== cluster Cluster
C = ClusterInput()
G = ClusterInput()
flip = FlipCurve(Curve=C, Guide=G)  # -> Curve, Flag
item = ListItem(List=flip.Curve, Index=0, Wrap=True)  # -> Item, Item1, Item2
data = ClusterInput()
R = ClusterInput()
data_2 = ClusterInput()
R_2 = ClusterInput()
end = EndPoints(Curve=item.Item2)  # -> Start, End
end_2 = EndPoints(Curve=item.Item)  # -> Start, End
end_3 = EndPoints(Curve=item.Item1)  # -> Start, End
data_3 = Data(data)
data_4 = Data(data_2)
vec2pt = Vector2Pt(PointA=data_4, PointB=end_3.Start, Unitize=False)  # -> Vector, Length
vec2pt_2 = Vector2Pt(PointA=data_4, PointB=end_2.Start, Unitize=False)  # -> Vector, Length
vec2pt_3 = Vector2Pt(PointA=data_3, PointB=end_3.End, Unitize=False)  # -> Vector, Length
vec2pt_4 = Vector2Pt(PointA=data_3, PointB=end.End, Unitize=False)  # -> Vector, Length
angle = Angle(VectorA=vec2pt_3.Vector, VectorB=vec2pt_4.Vector, Plane=data_3)  # -> Angle, Reflex
angle_2 = Angle(VectorA=vec2pt_2.Vector, VectorB=vec2pt.Vector, Plane=data_4)  # -> Angle, Reflex
arc = Arc(Plane=data_3, Radius=R, Angle=angle.Angle)  # -> Arc, Length
arc_2 = Arc(Plane=data_4, Radius=R_2, Angle=angle_2.Angle)  # -> Arc, Length
end_4 = EndPoints(Curve=arc.Arc)  # -> Start, End
end_5 = EndPoints(Curve=arc_2.Arc)  # -> Start, End
vec2pt_5 = Vector2Pt(PointA=data_3, PointB=end_4.Start, Unitize=False)  # -> Vector, Length
vec2pt_6 = Vector2Pt(PointA=data_4, PointB=end_5.Start, Unitize=False)  # -> Vector, Length
angle_3 = Angle(VectorA=vec2pt_2.Vector, VectorB=vec2pt_6.Vector, Plane=data_4)  # -> Angle, Reflex
angle_4 = Angle(VectorA=vec2pt_3.Vector, VectorB=vec2pt_5.Vector, Plane=data_3)  # -> Angle, Reflex
rotate = Rotate(Geometry=arc_2.Arc, Angle=expr("-x", angle_3.Angle), Plane=data_4)  # -> Geometry, Transform
rotate_2 = Rotate(Geometry=arc.Arc, Angle=expr("-x", angle_4.Angle), Plane=data_3)  # -> Geometry, Transform
G_2 = ClusterOutput(rotate.Geometry)
G_3 = ClusterOutput(rotate_2.Geometry)
