# Grasshopper definition TOOL-SyringePasteExtruderNema23.gh (Grasshopper 1.0.4)
# plug-ins: Pufferfish

motor_placement = Slider(40, range=0..100)
gearreducingfactor = Slider(32, range=0..100)
shaft_diametersstepper = Slider(6.35, range=0..15)
offset_of_shaft = Slider(3, range=0..10)
shaftscrewdiameter = Slider(3.5, range=0..10)
screw_shaft_position = Slider(0.75, range=0..2)
circular_shaft_multiplier = Slider(2, range=0..10)
number_slider = Slider(8, range=0..20)
zposition = Slider(15, range=0..200)
num = Number(motor_placement)
neg = Negative(Value=zposition)
expression = Expression(x=shaft_diametersstepper, Expression="x/2")
X = UnitX(Factor=num)
Y = UnitY(Factor=num)
pt = ConstructPoint(XCoordinate=0, YCoordinate=0, ZCoordinate=neg)
number_slider_2 = Slider(21, range=0..100)
move = Move(Geometry=pt, Motion=Y)  # -> Geometry, Transform
subtraction = Subtraction(A=num, B=gearreducingfactor)
division = Division(A=gearreducingfactor, B=subtraction)
panel = Panel(division)
cir = Circle(Plane=pt, Radius=gearreducingfactor)
# EXTRUDER POINT
# fixing plate
box = CenterBox(Base=move.Geometry, X=number_slider_2, Y=number_slider_2, Z=Slider(50, range=0..100))
cir_2 = Circle(Plane=move.Geometry, Radius=subtraction)
Z = UnitZ(Factor=number_slider)
# GEAR BOX
wires = BrepWireframe(Brep=box, Density=-1)
geo = Geometry([cir, cir_2])
move_2 = Move(Geometry=pt, Motion=Z)  # -> Geometry, Transform
gear_2d = Gears(
    A=geo,
    y=Slider(16, range=0..100),
    p=Slider(22.5, range=14.5..22.5),
    A_2=Slider(1.1, range=1..1.25),
    A_3=Slider(1.25, range=1.25..1.3))  # -> C, L, B, W
panel_2 = Panel(gear_2d.L)
number_slider_3 = Slider(8, range=0..10)
addition = Addition(A=Slider(10, range=0..10), B=number_slider_3)
Z_2 = UnitZ(Factor=number_slider)
cir_3 = Circle(Plane=move_2.Geometry, Radius=addition)
cir_4 = Circle(Plane=pt, Radius=Slider(4.5, range=0..10))
linedim = LineDimension(Line=gear_2d.W, Text="{0:0.00}", Size=1)
polygon = Polygon(Plane=move_2.Geometry, Radius=number_slider_3, Segments=Slider(6, range=0..10), FilletRadius=0)  # -> Polygon, Length
bang = ExplodeTree(Data=gear_2d.B)  # -> Branch0, Branch1
boundary = BoundarySurfaces(Edges=[polygon.Polygon, cir_3])
cir_5 = Circle(Plane=bang.Branch0, Radius=expression)
Z_3 = UnitZ(Factor=Slider(7, range=0..100))
panel_3 = Panel("2")
boundary_2 = BoundarySurfaces(Edges=gear_2d.C)
extr = Extrude(Base=flatten(boundary_2), Direction=Z_2)
extr_2 = Extrude(Base=flatten(boundary), Direction=Z_3)
boundary_3 = BoundarySurfaces(Edges=[cir_5, cir_4])
multiplication = Multiplication(A=number_slider, B=circular_shaft_multiplier)
offcrv = OffsetCurve(Curve=cir_5, Distance=offset_of_shaft, Plane=PlaneXY(0, 0, 0), BothSides=False, Kinks=0, CapType=1)
boundary_4 = BoundarySurfaces(Edges=offcrv)
Z_4 = UnitZ(Factor=multiplication)
Z_5 = UnitZ(Factor=Z_4)
extr_3 = Extrude(Base=flatten(boundary_3), Direction=Z_5)
eval = EvaluateCurve(Curve=reparameterize(offcrv), Parameter=Slider(0.5, range=0..1))  # -> Point, Tangent, Angle
extr_4 = Extrude(Base=flatten(boundary_4), Direction=Z_4)
multiplication_2 = Multiplication(A=Z_4, B=screw_shaft_position)
merge = Merge(Data1=extr_3)
move_3 = Move(Geometry=eval.Point, Motion=multiplication_2)  # -> Geometry, Transform
entwine = Entwine(Branch00=extr_4, Branch01=extr_2, FlattenInputs=True)  # -> simplify(Result)
expression_2 = Expression(x=shaftscrewdiameter, Expression="x/2")
yz = YZPlane(Origin=move_3.Geometry)
merge_2 = Merge(Data1=simplify(graft(extr)), Data2=entwine)
cir_6 = Circle(Plane=yz, Radius=expression_2)
X_2 = UnitX(Factor=shaft_diametersstepper)
extr_5 = Extrude(Base=flatten(cir_6), Direction=X_2)
sunion = SolidUnion(Breps=merge_2)
cap = CapHoles(Brep=extr_5)
merge_3 = Merge(Data1=merge, Data2=cap)  # -> flatten(Result)
sunion_2 = SolidUnion(Breps=merge_3)
sdiff = SolidDifference(BrepsA=flatten(sunion), BrepsB=sunion_2)
item = ListItem(List=sdiff, Index=0, Wrap=True)  # -> Item, Item1
bbox = BoundingBox(Content=item.Item1, Plane=PlaneXY(0, 0, 0))  # -> Box, Box_2
# List of common combinations
# of nominal diameter and pitch:
# 
# M Nominal Diameter x Pitch (mm)
boxprop = BoxProperties(Box=bbox.Box)  # -> Center, Diagonal, Area, Volume, Degeneracy
debox = DeconstructBox(Box=bbox.Box)  # -> Plane, X, Y, Z
dedomain = DeconstructDomain(Domain=debox.X)  # -> Start, End
subtraction_2 = Subtraction(A=dedomain.End, B=dedomain.Start)
panel_4 = Panel(subtraction_2)
geo_2 = Geometry(sdiff)

# ==== cluster Gears: Creat 2D Gears
A = ClusterInput()
y = ClusterInput()
p = ClusterInput()
A_2 = ClusterInput()
A_3 = ClusterInput()
lng = ListLength(List=A)  # -> expr("x-1", Length)
darc = DeconstructArc(Arc=A)  # -> BasePlane, Radius, Angle
expression = Expression(x=lng, Expression="if(x = 0, 0 ,1)")
expression_2 = Expression(x=lng, Expression="if(x = 0, 1 ,x)")
range = Range(Domain=lng, Steps=lng)
sort = SortList(Keys=darc.Radius, ValuesA=A)  # -> Keys, ValuesA
sort_2 = SortList(Keys=darc.Radius)  # -> Keys, ValuesA
darc_2 = DeconstructArc(Arc=sort.ValuesA)  # -> BasePlane, Radius, Angle
item = ListItem(List=sort.Keys, Index=0, Wrap=True)
filter = StreamFilter(Gate=expression, Stream0=expression_2, Stream1=range)
moudule = Evaluate(F="(x*2)/y", x=item, y=y)
eval = Evaluate(F="(x*2)/y", x=darc_2.Radius, y=moudule)
item_2 = ListItem(List=sort.ValuesA, Index=filter, Wrap=True)  # -> graft(Item)
item_3 = ListItem(List=eval, Index=filter, Wrap=True)  # -> graft(Item)
eval_2 = Evaluate(F="(x)*m", x=A_2, m=moudule)
eval_3 = Evaluate(F="(x)*m", x=A_2, m=moudule)
darc_3 = DeconstructArc(Arc=item_2)  # -> BasePlane, Radius, Angle
python = PythonScript(c=item_2, x=eval_2, y=eval_3, p=p)  # -> out, simplify(a), b, simplify(c), d
# ---------- python: Python ----------
import Rhino as rh
import Rhino.Geometry as rg
import math as m
import Grasshopper as gh


"""place a new circle"""
def newCir(c,ag,x):
    
    addR = x
    
    
    """Trigonmetry of bevel gear"""
    cirPl = rg.Circle.Plane.GetValue(c)
    cirOr = cirPl.Origin
    cirZ = cirPl.ZAxis
    cirR = rg.Circle.Radius.GetValue(c)
    
    r = cirR + addR
    
    
    
    return rg.Circle(cirPl,r), r


a ,b = newCir(c,d,x)
c, d = newCir(c,d,-y)
print a
# ---------- end python ----------
involute = PythonScript(r=darc_3.Radius, p=p)  # -> b
# ---------- involute: Python ----------
import math
import Rhino as rh

c = 0.019
t=0
ptList = []
a = math.cos(math.radians(p))*r
for i in range(0,50):
    t += c
    x = a * (math.cos(t) + t * math.sin(t))
    y = a * (math.sin(t) - t * math.cos(t))
    z = 0
    pts = rh.Geometry.Point3d(x,y,z)
    ptList.append(pts)

b = rh.Geometry.PolylineCurve.CreateInterpolatedCurve(ptList,3)
# ---------- end involute ----------
range_2 = Range(Domain="360", Steps=item_3)
orient = Orient(Geometry=involute, Source=PlaneXY(0, 0, 0), Target=darc_3.BasePlane)  # -> Geometry, Transform
multiplication = Multiplication(A=A_2, B="10")
multiplication_2 = Multiplication(A=A_3, B="10")
lng_2 = ListLength(List=range_2)
ext = ExtendCurve(Curve=orient.Geometry, Type=0, Start=multiplication, End=multiplication_2)
split = SplitList(List=range_2, Index=expr("x-1", lng_2))  # -> ListA, ListB
divide = DivideCurve(Curve=item_2, Count=expr("x-1", lng_2), Kinks=False)  # -> Points, Tangents, Parameters
item_4 = ListItem(List=divide.Parameters, Index=0, Wrap=True)  # -> Item, Item1
data = Data(darc_3.BasePlane)
mcx = MultipleCurves(Curves=[item_2, ext])  # -> Points, IndexA, IndexB, ParamA, ParamB
eval_4 = Evaluate(F="(x+y)/4", x=item_4.Item, y=item_4.Item1)
addition = Addition(A=mcx.ParamA, B=eval_4)
eval_5 = EvaluateCurve(Curve=item_2, Parameter=addition)  # -> Point, Tangent, Angle
trim = TrimWithRegions(Curve=ext, Regions=[python.a, python.c])  # -> Inside, Outside
move = Move(Geometry=data, Motion=data)  # -> Geometry, Transform
ln = Line(StartPoint=move.Geometry, EndPoint=data)
item_5 = ListItem(List=trim.Inside, Index=1, Wrap=True)  # -> simplify(Item)
lnpt = LinePt(Line=ln, Point=eval_5.Point)
mirror = Mirror(Geometry=item_5, Plane=lnpt)  # -> simplify(Geometry), Transform
rotate = Rotate(Geometry=item_5, Angle=degrees(split.ListA), Plane=data)  # -> simplify(Geometry), Transform
rotate_2 = Rotate(Geometry=mirror.Geometry, Angle=degrees(split.ListA), Plane=data)  # -> simplify(Geometry), Transform
lng_3 = ListLength(List=rotate.Geometry)
weave = Weave(Pattern=[0, 1], Stream0=rotate.Geometry, Stream1=rotate_2.Geometry, NullGaps=False)
cluster = Cluster(data_2=python.a, data=python.c, R_2=python.b, R=python.d, C=weave, G=ln)  # -> G_2, G_3
item_6 = ListItem(List=cluster.G_2, Index=0, Wrap=True)
end = EndPoints(Curve=item_6)  # -> Start, End
end_2 = EndPoints(Curve=mirror.Geometry)  # -> Start, End
rotate_3 = Rotate(Geometry=cluster.G_2, Angle=degrees(split.ListA), Plane=data)  # -> simplify(Geometry), Transform
rotate_4 = Rotate(Geometry=cluster.G_3, Angle=degrees(split.ListA), Plane=data)  # -> simplify(Geometry), Transform
ln_2 = Line(StartPoint=end.Start, EndPoint=end.End)  # -> flatten(Line)
ln_3 = Line(StartPoint=end_2.Start, EndPoint=end_2.End)  # -> flatten(Line)
join = JoinCurves(Curves=[weave, rotate_3.Geometry, rotate_4.Geometry], Preserve=False)  # -> simplify(Curves)
weave_2 = Weave(Pattern=[0, 1], Stream0=ln_2, Stream1=ln_3, NullGaps=False)
B = ClusterOutput(darc_3.BasePlane)
W = ClusterOutput(weave_2)
C = ClusterOutput(join)
L = ClusterOutput(lng_3)

# ==== cluster Cluster
C = ClusterInput()
G = ClusterInput()
flip = FlipCurve(Curve=C, Guide=G)  # -> Curve, Flag
item = ListItem(List=flip.Curve, Index=0, Wrap=True)  # -> Item, Item1, Item2
data = ClusterInput()
R = ClusterInput()
data_2 = ClusterInput()
R_2 = ClusterInput()
end = EndPoints(Curve=item.Item2)  # -> Start, End
end_2 = EndPoints(Curve=item.Item)  # -> Start, End
end_3 = EndPoints(Curve=item.Item1)  # -> Start, End
data_3 = Data(data)
data_4 = Data(data_2)
vec2pt = Vector2Pt(PointA=data_4, PointB=end_3.Start, Unitize=False)  # -> Vector, Length
vec2pt_2 = Vector2Pt(PointA=data_4, PointB=end_2.Start, Unitize=False)  # -> Vector, Length
vec2pt_3 = Vector2Pt(PointA=data_3, PointB=end_3.End, Unitize=False)  # -> Vector, Length
vec2pt_4 = Vector2Pt(PointA=data_3, PointB=end.End, Unitize=False)  # -> Vector, Length
angle = Angle(VectorA=vec2pt_3.Vector, VectorB=vec2pt_4.Vector, Plane=data_3)  # -> Angle, Reflex
angle_2 = Angle(VectorA=vec2pt_2.Vector, VectorB=vec2pt.Vector, Plane=data_4)  # -> Angle, Reflex
arc = Arc(Plane=data_3, Radius=R, Angle=angle.Angle)  # -> Arc, Length
arc_2 = Arc(Plane=data_4, Radius=R_2, Angle=angle_2.Angle)  # -> Arc, Length
end_4 = EndPoints(Curve=arc.Arc)  # -> Start, End
end_5 = EndPoints(Curve=arc_2.Arc)  # -> Start, End
vec2pt_5 = Vector2Pt(PointA=data_3, PointB=end_4.Start, Unitize=False)  # -> Vector, Length
vec2pt_6 = Vector2Pt(PointA=data_4, PointB=end_5.Start, Unitize=False)  # -> Vector, Length
angle_3 = Angle(VectorA=vec2pt_2.Vector, VectorB=vec2pt_6.Vector, Plane=data_4)  # -> Angle, Reflex
angle_4 = Angle(VectorA=vec2pt_3.Vector, VectorB=vec2pt_5.Vector, Plane=data_3)  # -> Angle, Reflex
rotate = Rotate(Geometry=arc_2.Arc, Angle=expr("-x", angle_3.Angle), Plane=data_4)  # -> Geometry, Transform
rotate_2 = Rotate(Geometry=arc.Arc, Angle=expr("-x", angle_4.Angle), Plane=data_3)  # -> Geometry, Transform
G_2 = ClusterOutput(rotate.Geometry)
G_3 = ClusterOutput(rotate_2.Geometry)
