# Grasshopper definition gear example.gh (Grasshopper 0.9.76)

# Elevation Circle does not input more than ONE
# because is impossible to have difference radius in bevel gears.
number_slider = Slider(90, range=90..360)

# ----
# Surf On show the surface.
# Please turn off if grasshopper run slowly.
toggle = BooleanToggle(True)

# ----
# the way to making more one gear is input several number to Postition.
toggle_2 = BooleanToggle(True)
gear_2d = Gears(
    A=[{Angle=0, Angle=6.283185307, Plane=PlaneXY(0, 0, 0), Radius=32}, {Angle=0, Angle=6.283185307, Plane=PlaneXY(64, 0, 0), Radius=32}],
    y=16,
    p=22.5,
    A_2=1,
    A_3=1.25)  # -> C, L, B, W
# Addendum range: 1 to 1.25
# Dedendum range: 1.25 to 1.3
# Pressure Angle:    14.5 to 22.5
rack_2d = GearRack(C=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, A_3={Plane=PlaneXY(0, 0, 0), Radius=30}, N=30, x=20, A_2=1, A=1.25, G=toggle_2)  # -> C_2, i
# equal surface
bg_eqd = BevelGear(
    base_circle={Plane=Plane(origin=(0, 0, 0), x=(0, 1, 0), y=(-1, 0, 0)), Radius=32},
    t=90,
    r1=28,
    d=90,
    B=Slider(7, range=0..50),
    y=16,
    p=22.5,
    A=1,
    A_2=1.25,
    data=Toggle(False))  # -> R, G, B_2, L, W
# same depth
bg = BevelGear_2(
    base_circle={Plane=Plane(origin=(0, 0, 0), x=(0, 1, 0), y=(-1, 0, 0)), Radius=32},
    t=number_slider,
    r1=25,
    d=90,
    Q=Slider(12, range=0..50),
    y=16,
    p=22.5,
    A=1,
    A_2=1.25,
    data=toggle)  # -> R, G, B, L, W
linedim = LineDimension(Line=[rack_2d.i, gear_2d.W], Text="{0:0.00}", Size=1)
# make a solid gear.
# this only work on 3d gear.
# input equal items (gear number)
solid = SolidBevelGear(D=bg.R, R=[Slider(5, range=0..10), Slider(5, range=0..10)], data_2=bg.B)
solid_2 = SolidBevelGear(D=bg_eqd.R, R=[Slider(5, range=0..10), Slider(5, range=0..10)], data_2=bg_eqd.B_2)
geo = Geometry(solid)
geo_2 = Geometry(solid_2)

# ==== cluster BevelGear: Providing a bevel gears with same depth
B = ClusterInput()
r1 = ClusterInput()
t = ClusterInput()
d = ClusterInput()
base_circle = ClusterInput()  # the bevel gear's base circle
y = ClusterInput()
p = ClusterInput()
A = ClusterInput()
A_2 = ClusterInput()
data = ClusterInput()
python = PythonScript(c=base_circle, t=t, d=d, r1=r1)  # -> out, Origin, nCirs, nCens, tanPt, xPt; inputs c: Curve
# ---------- python: Python ----------
import math as m
import Rhino as rh
import Rhino.Geometry as rg
import rhinoscriptsyntax as rs
import scriptcontext as sc
import Grasshopper as gh


dg = m.radians(d)
tp = (t/360)*rg.Curve.GetLength(c)
cFrame = rg.Curve.FrameAt(c,tp)
baseCir = rg.Curve.TryGetCircle(c)
baseCirP = baseCir[1].Plane

bcPt = baseCirP.Origin
bcZ = baseCirP.ZAxis
cPt = cFrame[1].Origin
cX = cFrame[1].XAxis
cY = cFrame[1].YAxis
cZ = cFrame[1].ZAxis

rg.Vector3d.Rotate(cY, dg, cX)
rg.Vector3d.Rotate(cZ, dg, cX)
rg.Vector3d.Reverse(cZ)
cYr = rg.Vector3d.Multiply(r1, cY)
r1Orient = rg.Point3d.Add(cPt, cYr)
r1Plane = rg.Plane(r1Orient, cZ)
newCir = rg.Circle(r1Plane, r1)

line1 = rg.Line(bcPt, bcZ, 3000)
line2 = rg.Line(r1Orient, cZ, 3000)

line1 = rg.Line.ToNurbsCurve(line1)
line2 = rg.Line.ToNurbsCurve(line2)
events = rg.Intersect.Intersection.CurveCurve(line1, line2, 0.01,  0.1)
ccxList = []
for ccx_event in events:
        ccxPt = sc.doc.Objects.AddPoint(ccx_event.PointA)

Origin = baseCirP.Origin
xPt = ccxPt
nCirs = newCir
nCens = r1Orient
tanPt = cFrame[1]
# ---------- end python ----------
vec2pt = Vector2Pt(PointA=python.xPt, PointB=python.nCens, Unitize=False)  # -> Vector, Length
vec2pt_2 = Vector2Pt(PointA=python.xPt, PointB=python.Origin, Unitize=False)  # -> Vector, Length
pl_3pt = Plane3Pt(PointA=python.xPt, PointB=python.Origin, PointC=python.tanPt)
vec2pt_3 = Vector2Pt(PointA=python.xPt, PointB=python.tanPt, Unitize=False)  # -> Vector, Length
item = ListItem(List=vec2pt_3.Vector, Index=0, Wrap=True)
item_2 = ListItem(List=vec2pt_2.Vector, Index=0, Wrap=True)
item_3 = ListItem(List=pl_3pt, Index=0, Wrap=True)
angle = Angle(VectorA=vec2pt_3.Vector, VectorB=vec2pt.Vector, Plane=pl_3pt)  # -> Angle, Reflex
angle_2 = Angle(VectorA=item, VectorB=item_2, Plane=item_3)  # -> Angle, Reflex
python_2 = PythonScript(x=angle.Angle)  # -> out, a
# ---------- python_2: Python ----------
import math as m

def degree(x):
    
    x = m.degrees(x)
    
    if m.fabs(x)>180:
        x = 360 - m.fabs(x)
        print x
    else:
        x = x
    
    return m.radians(x)


a = degree(x)
# ---------- end python_2 ----------
python_3 = PythonScript(x=angle_2.Angle)  # -> out, a; same code as python_2
merge = Merge(Data1=python_3.a, Data2=python_2.a)
merge_2 = Merge(Data1=base_circle, Data2=python.nCirs)
rtrig = RightTrigonometry(Alpha=merge, QLength=B)  # -> Alpha, Beta, PLength, QLength, RLength
panel = Panel(rtrig.PLength)
lng = ListLength(List=merge_2)  # -> expr("x-1", Length)
darc = DeconstructArc(Arc=merge_2)  # -> BasePlane, Radius, Angle
expression = Expression(x=lng, Expression="if(x = 0, 0 ,1)")
expression_2 = Expression(x=lng, Expression="if(x = 0, 1 ,x)")
sort = SortList(Keys=darc.Radius, ValuesA=rtrig.PLength)  # -> Keys, ValuesA
sort_2 = SortList(Keys=darc.Radius, ValuesA=merge_2)  # -> Keys, ValuesA
range = Range(Domain=lng, Steps=lng)
subtraction = Subtraction(A=sort.Keys, B=sort.ValuesA)
darc_2 = DeconstructArc(Arc=sort_2.ValuesA)  # -> BasePlane, Radius, Angle
item_4 = ListItem(List=sort_2.Keys, Index=0, Wrap=True)
division = Division(A=subtraction, B=sort.Keys)
filter = StreamFilter(Gate=expression, Stream0=expression_2, Stream1=range)
sort_3 = SortList(Keys=darc.Radius, ValuesA=merge)  # -> Keys, ValuesA
moudule = Evaluate(F="(x*2)/y", x=item_4, y=y)
eval = Evaluate(F="(x*2)/y", x=darc_2.Radius, y=moudule)
data_2 = Data(sort_2.ValuesA)
neg = Negative(Value=sort_3.ValuesA)
darc_3 = DeconstructArc(Arc=data_2)  # -> BasePlane, Radius, Angle
item_5 = ListItem(List=sort_2.ValuesA, Index=filter, Wrap=True)  # -> graft(Item)
item_6 = ListItem(List=eval, Index=filter, Wrap=True)  # -> graft(Item)
scale = Scale(Geometry=data_2, Center=darc_3.BasePlane, Factor=division)  # -> Geometry, Transform
eval_2 = Evaluate(F="(x)*m", x=A, m=moudule)
eval_3 = Evaluate(F="(x)*m", x=A, m=moudule)
darc_4 = DeconstructArc(Arc=item_5)  # -> BasePlane, Radius, Angle
darc_5 = DeconstructArc(Arc=scale.Geometry)  # -> BasePlane, Radius, Angle
python_4 = PythonScript(c=item_5, d=graft(sort_3.ValuesA), x=eval_2, y=eval_3, p=p)  # -> out, simplify(a), b, simplify(c), d
# ---------- python_4: Python ----------
import Rhino as rh
import Rhino.Geometry as rg
import math as m
import Grasshopper as gh


"""place a new circle"""
def newCir(c,ag,x):
    ag = d
    addR = x*m.cos(ag)
    addH = x*m.sin(ag)
    
    """Trigonmetry of bevel gear"""
    cirPl = rg.Circle.Plane.GetValue(c)
    cirOr = cirPl.Origin
    cirZ = cirPl.ZAxis
    cirR = rg.Circle.Radius.GetValue(c)
    
    r = cirR + addR
    
    newZ = rg.Vector3d.Multiply(addH,cirZ)
    newOr = rg.Point3d.Add(newZ, cirOr)
    newPl = rg.Plane(newOr, cirZ)
    
    return rg.Circle(newPl,r), r


a ,b = newCir(c,d,x)
c, d = newCir(c,d,-y)
print a
# ---------- end python_4 ----------
deplane = DeconstructPlane(Plane=darc_5.BasePlane)  # -> Origin, XAxis, YAxis, ZAxis
involute = PythonScript(r=darc_4.Radius, p=p)  # -> b
# ---------- involute: Python ----------
import math
import Rhino as rh

c = 0.019
t=0
ptList = []
a = math.cos(math.radians(p))*r
for i in range(0,50):
    t += c
    x = a * (math.cos(t) + t * math.sin(t))
    y = a * (math.sin(t) - t * math.cos(t))
    z = 0
    pts = rh.Geometry.Point3d(x,y,z)
    ptList.append(pts)

b = rh.Geometry.PolylineCurve.CreateInterpolatedCurve(ptList,3)
# ---------- end involute ----------
range_2 = Range(Domain="360", Steps=item_6)
points = PointList(Points=darc_5.BasePlane, Size=12)
orient = Orient(Geometry=involute, Source=PlaneXY(0, 0, 0), Target=darc_4.BasePlane)  # -> Geometry, Transform
lng_2 = ListLength(List=range_2)
multiplication = Multiplication(A=A, B="10")
multiplication_2 = Multiplication(A=deplane.ZAxis, B=B)
multiplication_3 = Multiplication(A=A_2, B="10")
split = SplitList(List=range_2, Index=expr("x-1", lng_2))  # -> ListA, ListB
divide = DivideCurve(Curve=item_5, Count=expr("x-1", lng_2), Kinks=False)  # -> Points, Tangents, Parameters
ext = ExtendCurve(Curve=orient.Geometry, Type=0, Start=multiplication, End=multiplication_3)
item_7 = ListItem(List=divide.Parameters, Index=0, Wrap=True)  # -> Item, Item1
data_3 = Data(darc_4.BasePlane)
mcx = MultipleCurves(Curves=[item_5, ext])  # -> Points, IndexA, IndexB, ParamA, ParamB
eval_4 = Evaluate(F="(x+y)/4", x=item_7.Item, y=item_7.Item1)
addition = Addition(A=mcx.ParamA, B=eval_4)
eval_5 = EvaluateCurve(Curve=item_5, Parameter=addition)  # -> Point, Tangent, Angle
ln = Line(StartPoint=mcx.Points, EndPoint=eval_5.Point)
rotax = RotateAxis(Geometry=simplify(ext), Angle=simplify(graft(neg)), Axis=simplify(ln))  # -> simplify(Geometry), Transform
move = Move(Geometry=data_3, Motion=data_3)  # -> Geometry, Transform
ln_2 = Line(StartPoint=move.Geometry, EndPoint=data_3)
loft = Loft(
    Curves=[python_4.a, python_4.c],
    Options={Adjust=False, Closed=False, LoftEnds=0, LoftSimp=0, LoftType=0, Rebuild=10, Refit=0.01})
project = Project(Curve=rotax.Geometry, Brep=loft, Direction=python_4.a)
lnpt = LinePt(Line=ln_2, Point=eval_5.Point)
item_8 = ListItem(List=project, Index=0, Wrap=True)  # -> simplify(Item)
mirror = Mirror(Geometry=item_8, Plane=lnpt)  # -> simplify(Geometry), Transform
rotate = Rotate(Geometry=item_8, Angle=degrees(split.ListA), Plane=data_3)  # -> simplify(Geometry), Transform
rotate_2 = Rotate(Geometry=mirror.Geometry, Angle=degrees(split.ListA), Plane=data_3)  # -> simplify(Geometry), Transform
lng_3 = ListLength(List=rotate.Geometry)
weave = Weave(Pattern=[0, 1], Stream0=rotate.Geometry, Stream1=rotate_2.Geometry, NullGaps=False)
L = ClusterOutput(lng_3)
data_4 = Data(division)
data_5 = Data(darc_4.BasePlane)
cluster = Cluster(data_2=python_4.a, data=python_4.c, R_2=python_4.b, R=python_4.d, C=weave, G=ln_2)  # -> G_2, G_3, G_4
edgesrf = EdgeSurface(CurveA=cluster.G_2, CurveB=mirror.Geometry, CurveC=item_8, CurveD=cluster.G_4)
rotate_3 = Rotate(Geometry=cluster.G_2, Angle=degrees(split.ListA), Plane=data_3)  # -> simplify(Geometry), Transform
rotate_4 = Rotate(Geometry=cluster.G_3, Angle=degrees(split.ListA), Plane=data_3)  # -> simplify(Geometry), Transform
rotate_5 = Rotate(Geometry=edgesrf, Angle=degrees(split.ListA), Plane=data_3)  # -> simplify(Geometry), Transform
join = JoinCurves(Curves=[weave, rotate_3.Geometry, rotate_4.Geometry], Preserve=False)  # -> simplify(Curves)
group = Group(Objects=rotate_5.Geometry)
scale_2 = Scale(Geometry=flatten(join), Center=flatten(data_5), Factor=data_4)  # -> Geometry, Transform
scale_3 = Scale(Geometry=flatten(group), Center=flatten(data_5), Factor=data_4)  # -> Geometry, Transform
scale_4 = Scale(Geometry=flatten(python_4.c), Center=flatten(data_5), Factor=data_4)  # -> Geometry, Transform
move_2 = Move(Geometry=scale_3.Geometry, Motion=multiplication_2)  # -> simplify(graft(Geometry)), Transform
move_3 = Move(Geometry=scale_2.Geometry, Motion=multiplication_2)  # -> simplify(graft(Geometry)), Transform
move_4 = Move(Geometry=scale_4.Geometry, Motion=multiplication_2)  # -> simplify(graft(Geometry)), Transform
item_9 = ListItem(List=cluster.G_2, Index=0, Wrap=True)
data_6 = Data(data)
end = EndPoints(Curve=item_9)  # -> Start, End
end_2 = EndPoints(Curve=mirror.Geometry)  # -> Start, End
ln_3 = Line(StartPoint=end.Start, EndPoint=end.End)  # -> flatten(Line)
ln_4 = Line(StartPoint=end_2.Start, EndPoint=end_2.End)  # -> flatten(Line)
ln_5 = Line(StartPoint=python_4.c, EndPoint=move_4.Geometry)
cull = CullPattern(List=move_3.Geometry, CullPattern=data_6)  # -> simplify(List)
cull_2 = CullPattern(List=move_2.Geometry, CullPattern=data_6)  # -> simplify(List)
cull_3 = CullPattern(List=join, CullPattern=data_6)  # -> simplify(List)
cull_4 = CullPattern(List=group, CullPattern=data_6)  # -> simplify(List)
ungroup = Ungroup(Group=cull_2)  # -> simplify(Objects)
ungroup_2 = Ungroup(Group=cull_4)  # -> simplify(Objects)
weave_2 = Weave(Pattern=[0, 1, 2], Stream0=ln_3, Stream1=ln_4, Stream2=ln_5, NullGaps=False)
loft_2 = Loft(Curves=[cull, cull_3], Options={Adjust=False, Closed=False, LoftEnds=0, LoftSimp=0, LoftType=0, Rebuild=10, Refit=0.01})
merge_3 = Merge(Data1=move_4.Geometry, Data2=python_4.c)
join_2 = BrepJoin(Breps=[loft_2, ungroup, ungroup_2])  # -> Breps, Closed
R = ClusterOutput(merge_3)
G = ClusterOutput([move_3.Geometry, join])
B_2 = ClusterOutput(join_2.Breps)
W = ClusterOutput(weave_2)

# ==== cluster Gears: Creat 2D Gears
A = ClusterInput()
y = ClusterInput()
p = ClusterInput()
A_2 = ClusterInput()
A_3 = ClusterInput()
lng = ListLength(List=A)  # -> expr("x-1", Length)
darc = DeconstructArc(Arc=A)  # -> BasePlane, Radius, Angle
expression = Expression(x=lng, Expression="if(x = 0, 0 ,1)")
expression_2 = Expression(x=lng, Expression="if(x = 0, 1 ,x)")
sort = SortList(Keys=darc.Radius, ValuesA=A)  # -> Keys, ValuesA
sort_2 = SortList(Keys=darc.Radius)  # -> Keys, ValuesA
range = Range(Domain=lng, Steps=lng)
darc_2 = DeconstructArc(Arc=sort.ValuesA)  # -> BasePlane, Radius, Angle
item = ListItem(List=sort.Keys, Index=0, Wrap=True)
filter = StreamFilter(Gate=expression, Stream0=expression_2, Stream1=range)
moudule = Evaluate(F="(x*2)/y", x=item, y=y)
eval = Evaluate(F="(x*2)/y", x=darc_2.Radius, y=moudule)
item_2 = ListItem(List=sort.ValuesA, Index=filter, Wrap=True)  # -> graft(Item)
item_3 = ListItem(List=eval, Index=filter, Wrap=True)  # -> graft(Item)
darc_3 = DeconstructArc(Arc=item_2)  # -> BasePlane, Radius, Angle
eval_2 = Evaluate(F="(x)*m", x=A_2, m=moudule)
eval_3 = Evaluate(F="(x)*m", x=A_2, m=moudule)
python = PythonScript(c=item_2, x=eval_2, y=eval_3, p=p)  # -> out, simplify(a), b, simplify(c), d
# ---------- python: Python ----------
import Rhino as rh
import Rhino.Geometry as rg
import math as m
import Grasshopper as gh


"""place a new circle"""
def newCir(c,ag,x):
    
    addR = x
    
    
    """Trigonmetry of bevel gear"""
    cirPl = rg.Circle.Plane.GetValue(c)
    cirOr = cirPl.Origin
    cirZ = cirPl.ZAxis
    cirR = rg.Circle.Radius.GetValue(c)
    
    r = cirR + addR
    
    
    
    return rg.Circle(cirPl,r), r


a ,b = newCir(c,d,x)
c, d = newCir(c,d,-y)
print a
# ---------- end python ----------
range_2 = Range(Domain="360", Steps=item_3)
involute = PythonScript(r=darc_3.Radius, p=p)  # -> b; same code as involute
orient = Orient(Geometry=involute, Source=PlaneXY(0, 0, 0), Target=darc_3.BasePlane)  # -> Geometry, Transform
multiplication = Multiplication(A=A_2, B="10")
multiplication_2 = Multiplication(A=A_3, B="10")
lng_2 = ListLength(List=range_2)
ext = ExtendCurve(Curve=orient.Geometry, Type=0, Start=multiplication, End=multiplication_2)
split = SplitList(List=range_2, Index=expr("x-1", lng_2))  # -> ListA, ListB
divide = DivideCurve(Curve=item_2, Count=expr("x-1", lng_2), Kinks=False)  # -> Points, Tangents, Parameters
item_4 = ListItem(List=divide.Parameters, Index=0, Wrap=True)  # -> Item, Item1
data = Data(darc_3.BasePlane)
mcx = MultipleCurves(Curves=[item_2, ext])  # -> Points, IndexA, IndexB, ParamA, ParamB
eval_4 = Evaluate(F="(x+y)/4", x=item_4.Item, y=item_4.Item1)
addition = Addition(A=mcx.ParamA, B=eval_4)
eval_5 = EvaluateCurve(Curve=item_2, Parameter=addition)  # -> Point, Tangent, Angle
trim = TrimWithRegions(Curve=ext, Regions=[python.a, python.c])  # -> Inside, Outside
move = Move(Geometry=data, Motion=data)  # -> Geometry, Transform
ln = Line(StartPoint=move.Geometry, EndPoint=data)
item_5 = ListItem(List=trim.Inside, Index=1, Wrap=True)  # -> simplify(Item)
lnpt = LinePt(Line=ln, Point=eval_5.Point)
mirror = Mirror(Geometry=item_5, Plane=lnpt)  # -> simplify(Geometry), Transform
rotate = Rotate(Geometry=item_5, Angle=degrees(split.ListA), Plane=data)  # -> simplify(Geometry), Transform
rotate_2 = Rotate(Geometry=mirror.Geometry, Angle=degrees(split.ListA), Plane=data)  # -> simplify(Geometry), Transform
lng_3 = ListLength(List=rotate.Geometry)
weave = Weave(Pattern=[0, 1], Stream0=rotate.Geometry, Stream1=rotate_2.Geometry, NullGaps=False)
cluster = Cluster_2(data_2=python.a, data=python.c, R_2=python.b, R=python.d, C=weave, G=ln)  # -> G_2, G_3
item_6 = ListItem(List=cluster.G_2, Index=0, Wrap=True)
end = EndPoints(Curve=item_6)  # -> Start, End
end_2 = EndPoints(Curve=mirror.Geometry)  # -> Start, End
rotate_3 = Rotate(Geometry=cluster.G_2, Angle=degrees(split.ListA), Plane=data)  # -> simplify(Geometry), Transform
rotate_4 = Rotate(Geometry=cluster.G_3, Angle=degrees(split.ListA), Plane=data)  # -> simplify(Geometry), Transform
ln_2 = Line(StartPoint=end.Start, EndPoint=end.End)  # -> flatten(Line)
ln_3 = Line(StartPoint=end_2.Start, EndPoint=end_2.End)  # -> flatten(Line)
join = JoinCurves(Curves=[weave, rotate_3.Geometry, rotate_4.Geometry], Preserve=False)  # -> simplify(Curves)
weave_2 = Weave(Pattern=[0, 1], Stream0=ln_2, Stream1=ln_3, NullGaps=False)
B = ClusterOutput(darc_3.BasePlane)
W = ClusterOutput(weave_2)
C = ClusterOutput(join)
L = ClusterOutput(lng_3)

# ==== cluster GearRack: Creat 2D Rack Gear
G = ClusterInput()
A = ClusterInput()
A_2 = ClusterInput()
N = ClusterInput()
x = ClusterInput()
C = ClusterInput()
A_3 = ClusterInput()
darc = DeconstructArc(Arc=A_3)  # -> BasePlane, Radius, Angle
darc_2 = DeconstructArc(Arc=A_3)  # -> BasePlane, Radius, Angle
sort = SortList(Keys=darc_2.Radius, ValuesA=A_3)  # -> Keys, ValuesA
sort_2 = SortList(Keys=darc.Radius, ValuesA=A_3)  # -> Keys, ValuesA
range = Range(Domain=Domain(0, 1), Steps=N)
darc_3 = DeconstructArc(Arc=sort.ValuesA)  # -> BasePlane, Radius, Angle
shift = ShiftList(List=range, Shift=1, Wrap=False)
item = ListItem(List=sort_2.ValuesA, Index=0, Wrap=True)
bnd = Bounds(Numbers=darc_3.Radius)
shatter = Shatter(Curve=reparameterize(item), Parameters=shift)
dedomain = DeconstructDomain(Domain=bnd)  # -> Start, End
len = Length(Curve=shatter)
moudule = Evaluate(F="(x*2)/y", x=dedomain.Start, y=N)
item_2 = ListItem(List=len, Index=0, Wrap=True)
division = Division(A=item_2, B=2)
multiplication = Multiplication(A=A, B=moudule)
multiplication_2 = Multiplication(A=A_2, B=moudule)
divlength = DivideLength(Curve=C, Length=division)  # -> Points, Tangents, simplify(Parameters)
merge = Merge(Data1=multiplication, Data2=multiplication_2)
merge_2 = Merge(Data1=multiplication_2, Data2=multiplication)
lng = ListLength(List=divlength.Parameters)
lng_2 = ListLength(List=divlength.Parameters)
tstat = TreeStatistics(Tree=lng)  # -> Paths, Length, Count
filter = StreamFilter(Gate=G, Stream0=merge, Stream1=merge_2)
sort_3 = SortList(Keys=flatten(lng), ValuesA=tstat.Paths)  # -> Keys, ValuesA
lng_3 = ListLength(List=tstat.Paths)
dispatch = Dispatch(List=filter, DispatchPattern=[True, False])  # -> ListA, ListB
item_3 = ListItem(List=sort_3.ValuesA, Index=expr("x-1", lng_3), Wrap=True)
panel = Panel(merge_2)
sin = Sine(Value=degrees(x))
branch = TreeBranch(Tree=divlength.Parameters, Path=item_3, MaintainPaths=True)
cos = Cosine(Value=degrees(x))
hframe = HorizontalFrame(Curve=graft(C), Parameter=branch)
tan = Tangent(Value=degrees(x))
vec = VectorXYZ(XComponent=cos, YComponent=sin, ZComponent=0)  # -> Vector, Length
neg = Negative(Value=cos)
xy = XYPlane(Origin=Point(0, 0, 0))
multiplication_3 = Multiplication(A=tan, B=dispatch.ListA)
vec_2 = VectorXYZ(XComponent=neg, YComponent=sin, ZComponent=0)  # -> Vector, Length
multiplication_4 = Multiplication(A=tan, B=dispatch.ListB)
dispatch_2 = Dispatch(List=hframe, DispatchPattern=[True, False])  # -> ListA, ListB
prot = RotatePlane(Plane=xy, Angle=degrees(Slider(90, range=0..100)))
rev = Reverse(Vector=vec.Vector)
rev_2 = Reverse(Vector=vec_2.Vector)
division_2 = Division(A=multiplication_3, B=sin)
division_3 = Division(A=multiplication_4, B=sin)
line = LineSDL(Start=prot, Direction=vec_2.Vector, Length=division_3)
line_2 = LineSDL(Start=prot, Direction=rev_2, Length=division_2)
line_3 = LineSDL(Start=prot, Direction=rev, Length=division_3)
line_4 = LineSDL(Start=xy, Direction=vec.Vector, Length=division_2)
join = JoinCurves(Curves=[line_2, line], Preserve=False)
join_2 = JoinCurves(Curves=[line_3, line_4], Preserve=False)
orient = Orient(Geometry=join, Source=prot, Target=dispatch_2.ListA)  # -> Geometry, Transform
orient_2 = Orient(Geometry=join_2, Source=prot, Target=dispatch_2.ListB)  # -> Geometry, Transform
end = EndPoints(Curve=[orient_2.Geometry, orient.Geometry])  # -> Start, End
data = Data([end.Start, end.End])
multiplication_5 = Multiplication(A=lng_2, B=2)
alongcrv = SortAlongCurve(Points=simplify(data), Curve=simplify(graft(C)))  # -> Points, Indices
split = SplitList(List=alongcrv.Points, Index=expr("x-1", multiplication_5))  # -> ListA, ListB
shift_2 = ShiftList(List=split.ListA, Shift=1, Wrap=False)
ln = Line(StartPoint=shift_2, EndPoint=split.ListA)
join_3 = JoinCurves(Curves=reparameterize(flatten(ln)), Preserve=False)
item_4 = ListItem(List=ln, Index=1, Wrap=True)
i = ClusterOutput(item_4)
C_2 = ClusterOutput(join_3)

# ==== cluster BevelGear_2: Providing a bevel gears, which gears depth are follow the base cir
Q = ClusterInput()
r1 = ClusterInput()
t = ClusterInput()
d = ClusterInput()
base_circle = ClusterInput()  # the bevel gear's base circle
y = ClusterInput()
p = ClusterInput()
A = ClusterInput()
A_2 = ClusterInput()
data = ClusterInput()
python = PythonScript(c=base_circle, t=t, d=d, r1=r1)  # -> out, Origin, nCirs, nCens, tanPt, xPt; inputs c: Curve; same code as python
vec2pt = Vector2Pt(PointA=python.xPt, PointB=python.nCens, Unitize=False)  # -> Vector, Length
vec2pt_2 = Vector2Pt(PointA=python.xPt, PointB=python.Origin, Unitize=False)  # -> Vector, Length
pl_3pt = Plane3Pt(PointA=python.xPt, PointB=python.Origin, PointC=python.tanPt)
vec2pt_3 = Vector2Pt(PointA=python.xPt, PointB=python.tanPt, Unitize=False)  # -> Vector, Length
item = ListItem(List=vec2pt_3.Vector, Index=0, Wrap=True)
item_2 = ListItem(List=vec2pt_2.Vector, Index=0, Wrap=True)
item_3 = ListItem(List=pl_3pt, Index=0, Wrap=True)
angle = Angle(VectorA=vec2pt_3.Vector, VectorB=vec2pt.Vector, Plane=pl_3pt)  # -> Angle, Reflex
angle_2 = Angle(VectorA=item, VectorB=item_2, Plane=item_3)  # -> Angle, Reflex
python_2 = PythonScript(x=angle.Reflex)  # -> out, a; same code as python_2
python_3 = PythonScript(x=angle_2.Angle)  # -> out, a; same code as python_2
merge = Merge(Data1=python_3.a, Data2=python_2.a)
rtrig = RightTrigonometry(Alpha=python_3.a, QLength=Q)  # -> Alpha, Beta, PLength, QLength, RLength
merge_2 = Merge(Data1=base_circle, Data2=python.nCirs)
rtrig_2 = RightTrigonometry(Alpha=python_2.a, RLength=rtrig.RLength)  # -> Alpha, Beta, PLength, QLength, RLength
lng = ListLength(List=merge_2)  # -> expr("x-1", Length)
darc = DeconstructArc(Arc=merge_2)  # -> BasePlane, Radius, Angle
expression = Expression(x=lng, Expression="if(x = 0, 0 ,1)")
expression_2 = Expression(x=lng, Expression="if(x = 0, 1 ,x)")
merge_3 = Merge(Data1=rtrig.PLength, Data2=rtrig_2.PLength)
sort = SortList(Keys=darc.Radius, ValuesA=merge_3)  # -> Keys, ValuesA
sort_2 = SortList(Keys=darc.Radius, ValuesA=merge_2)  # -> Keys, ValuesA
range = Range(Domain=lng, Steps=lng)
subtraction = Subtraction(A=sort.Keys, B=sort.ValuesA)
merge_4 = Merge(Data1=Q, Data2=rtrig_2.QLength)
darc_2 = DeconstructArc(Arc=sort_2.ValuesA)  # -> BasePlane, Radius, Angle
item_4 = ListItem(List=sort_2.Keys, Index=0, Wrap=True)
division = Division(A=subtraction, B=sort.Keys)
filter = StreamFilter(Gate=expression, Stream0=expression_2, Stream1=range)
sort_3 = SortList(Keys=darc.Radius, ValuesA=merge)  # -> Keys, ValuesA
sort_4 = SortList(Keys=darc.Radius, ValuesA=merge_4)  # -> Keys, ValuesA
moudule = Evaluate(F="(x*2)/y", x=item_4, y=y)
eval = Evaluate(F="(x*2)/y", x=darc_2.Radius, y=moudule)
data_2 = Data(sort_2.ValuesA)
neg = Negative(Value=sort_3.ValuesA)
darc_3 = DeconstructArc(Arc=data_2)  # -> BasePlane, Radius, Angle
item_5 = ListItem(List=sort_2.ValuesA, Index=filter, Wrap=True)  # -> graft(Item)
item_6 = ListItem(List=eval, Index=filter, Wrap=True)  # -> graft(Item)
scale = Scale(Geometry=data_2, Center=darc_3.BasePlane, Factor=division)  # -> Geometry, Transform
eval_2 = Evaluate(F="(x)*m", x=A, m=moudule)
eval_3 = Evaluate(F="(x)*m", x=A, m=moudule)
darc_4 = DeconstructArc(Arc=item_5)  # -> BasePlane, Radius, Angle
darc_5 = DeconstructArc(Arc=scale.Geometry)  # -> BasePlane, Radius, Angle
python_4 = PythonScript(c=item_5, d=graft(sort_3.ValuesA), x=eval_2, y=eval_3, p=p)  # -> out, simplify(a), b, simplify(c), d; same code as python_4
involute = PythonScript(r=darc_4.Radius, p=p)  # -> b; same code as involute
deplane = DeconstructPlane(Plane=darc_5.BasePlane)  # -> Origin, XAxis, YAxis, ZAxis
points = PointList(Points=darc_5.BasePlane, Size=12)
range_2 = Range(Domain="360", Steps=item_6)
orient = Orient(Geometry=involute, Source=PlaneXY(0, 0, 0), Target=darc_4.BasePlane)  # -> Geometry, Transform
multiplication = Multiplication(A=deplane.ZAxis, B=sort_4.ValuesA)
lng_2 = ListLength(List=range_2)
multiplication_2 = Multiplication(A=A, B="10")
multiplication_3 = Multiplication(A=A_2, B="10")
split = SplitList(List=range_2, Index=expr("x-1", lng_2))  # -> ListA, ListB
divide = DivideCurve(Curve=item_5, Count=expr("x-1", lng_2), Kinks=False)  # -> Points, Tangents, Parameters
ext = ExtendCurve(Curve=orient.Geometry, Type=0, Start=multiplication_2, End=multiplication_3)
item_7 = ListItem(List=divide.Parameters, Index=0, Wrap=True)  # -> Item, Item1
data_3 = Data(darc_4.BasePlane)
mcx = MultipleCurves(Curves=[item_5, ext])  # -> Points, IndexA, IndexB, ParamA, ParamB
eval_4 = Evaluate(F="(x+y)/4", x=item_7.Item, y=item_7.Item1)
addition = Addition(A=mcx.ParamA, B=eval_4)
eval_5 = EvaluateCurve(Curve=item_5, Parameter=addition)  # -> Point, Tangent, Angle
ln = Line(StartPoint=mcx.Points, EndPoint=eval_5.Point)
rotax = RotateAxis(Geometry=simplify(ext), Angle=simplify(graft(neg)), Axis=simplify(ln))  # -> simplify(Geometry), Transform
move = Move(Geometry=data_3, Motion=data_3)  # -> Geometry, Transform
ln_2 = Line(StartPoint=move.Geometry, EndPoint=data_3)
loft = Loft(
    Curves=[python_4.a, python_4.c],
    Options={Adjust=False, Closed=False, LoftEnds=0, LoftSimp=0, LoftType=0, Rebuild=10, Refit=0.01})
project = Project(Curve=rotax.Geometry, Brep=loft, Direction=python_4.a)
lnpt = LinePt(Line=ln_2, Point=eval_5.Point)
item_8 = ListItem(List=project, Index=0, Wrap=True)  # -> simplify(Item)
mirror = Mirror(Geometry=item_8, Plane=lnpt)  # -> simplify(Geometry), Transform
rotate = Rotate(Geometry=item_8, Angle=degrees(split.ListA), Plane=data_3)  # -> simplify(Geometry), Transform
rotate_2 = Rotate(Geometry=mirror.Geometry, Angle=degrees(split.ListA), Plane=data_3)  # -> simplify(Geometry), Transform
lng_3 = ListLength(List=rotate.Geometry)
weave = Weave(Pattern=[0, 1], Stream0=rotate.Geometry, Stream1=rotate_2.Geometry, NullGaps=False)
L = ClusterOutput(lng_3)
data_4 = Data(division)
data_5 = Data(darc_4.BasePlane)
cluster = Cluster(data_2=python_4.a, data=python_4.c, R_2=python_4.b, R=python_4.d, C=weave, G=ln_2)  # -> G_2, G_3, G_4
edgesrf = EdgeSurface(CurveA=cluster.G_2, CurveB=mirror.Geometry, CurveC=item_8, CurveD=cluster.G_4)
rotate_3 = Rotate(Geometry=cluster.G_2, Angle=degrees(split.ListA), Plane=data_3)  # -> simplify(Geometry), Transform
rotate_4 = Rotate(Geometry=cluster.G_3, Angle=degrees(split.ListA), Plane=data_3)  # -> simplify(Geometry), Transform
rotate_5 = Rotate(Geometry=edgesrf, Angle=degrees(split.ListA), Plane=data_3)  # -> simplify(Geometry), Transform
join = JoinCurves(Curves=[weave, rotate_3.Geometry, rotate_4.Geometry], Preserve=False)  # -> simplify(Curves)
group = Group(Objects=rotate_5.Geometry)
scale_2 = Scale(Geometry=flatten(join), Center=flatten(data_5), Factor=data_4)  # -> Geometry, Transform
scale_3 = Scale(Geometry=flatten(group), Center=flatten(data_5), Factor=data_4)  # -> Geometry, Transform
scale_4 = Scale(Geometry=flatten(python_4.c), Center=flatten(data_5), Factor=data_4)  # -> Geometry, Transform
move_2 = Move(Geometry=scale_2.Geometry, Motion=multiplication)  # -> simplify(graft(Geometry)), Transform
move_3 = Move(Geometry=scale_4.Geometry, Motion=multiplication)  # -> simplify(graft(Geometry)), Transform
move_4 = Move(Geometry=scale_3.Geometry, Motion=multiplication)  # -> simplify(graft(Geometry)), Transform
item_9 = ListItem(List=cluster.G_2, Index=0, Wrap=True)
data_6 = Data(data)
end = EndPoints(Curve=item_9)  # -> Start, End
end_2 = EndPoints(Curve=mirror.Geometry)  # -> Start, End
ln_3 = Line(StartPoint=end.Start, EndPoint=end.End)  # -> flatten(Line)
ln_4 = Line(StartPoint=end_2.Start, EndPoint=end_2.End)  # -> flatten(Line)
ln_5 = Line(StartPoint=python_4.c, EndPoint=move_3.Geometry)
cull = CullPattern(List=move_2.Geometry, CullPattern=data_6)  # -> simplify(List)
cull_2 = CullPattern(List=move_4.Geometry, CullPattern=data_6)  # -> simplify(List)
cull_3 = CullPattern(List=join, CullPattern=data_6)  # -> simplify(List)
cull_4 = CullPattern(List=group, CullPattern=data_6)  # -> simplify(List)
ungroup = Ungroup(Group=cull_2)  # -> simplify(Objects)
ungroup_2 = Ungroup(Group=cull_4)  # -> simplify(Objects)
weave_2 = Weave(Pattern=[0, 1, 2], Stream0=ln_3, Stream1=ln_4, Stream2=ln_5, NullGaps=False)
loft_2 = Loft(Curves=[cull, cull_3], Options={Adjust=False, Closed=False, LoftEnds=0, LoftSimp=0, LoftType=0, Rebuild=10, Refit=0.01})
merge_5 = Merge(Data1=move_3.Geometry, Data2=python_4.c)
join_2 = BrepJoin(Breps=[loft_2, ungroup, ungroup_2])  # -> Breps, Closed
R = ClusterOutput(merge_5)
G = ClusterOutput([move_2.Geometry, join])
B = ClusterOutput(join_2.Breps)
W = ClusterOutput(weave_2)

# ==== cluster SolidBevelGear: Solidify bevel gear
D = ClusterInput()
R = ClusterInput()
flip = FlipMatrix(Data=D)
cir = Circle(Plane=flip, Radius=R)
flip_2 = FlipMatrix(Data=cir)  # -> graft(Data)
flip_3 = FlipMatrix(Data=cir)
data = Data(graft(D))
data_2 = ClusterInput()
boundary = BoundarySurfaces(Edges=[flip_2, data])  # -> simplify(Surfaces)
panel = Panel(flip_3)
data_3 = Data(data_2)
loft = Loft(Curves=flip_3, Options={Adjust=False, Closed=False, LoftEnds=0, LoftSimp=0, LoftType=0, Rebuild=10, Refit=0.01})
pshift = ShiftPaths(Data=boundary, Offset=-1)
join = BrepJoin(Breps=[pshift, loft, data_3])  # -> Breps, Closed
B = ClusterOutput(join.Breps)

# ==== cluster Cluster
C = ClusterInput()
G = ClusterInput()
flip = FlipCurve(Curve=C, Guide=G)  # -> Curve, Flag
item = ListItem(List=flip.Curve, Index=0, Wrap=True)  # -> Item, Item1, Item2
data = ClusterInput()
R = ClusterInput()
data_2 = ClusterInput()
R_2 = ClusterInput()
end = EndPoints(Curve=item.Item2)  # -> Start, End
end_2 = EndPoints(Curve=item.Item)  # -> Start, End
end_3 = EndPoints(Curve=item.Item1)  # -> Start, End
data_3 = Data(data)
data_4 = Data(data_2)
vec2pt = Vector2Pt(PointA=data_4, PointB=end_3.Start, Unitize=False)  # -> Vector, Length
vec2pt_2 = Vector2Pt(PointA=data_4, PointB=end_2.Start, Unitize=False)  # -> Vector, Length
vec2pt_3 = Vector2Pt(PointA=data_3, PointB=end_3.End, Unitize=False)  # -> Vector, Length
vec2pt_4 = Vector2Pt(PointA=data_3, PointB=end_3.End, Unitize=False)  # -> Vector, Length
vec2pt_5 = Vector2Pt(PointA=data_3, PointB=end_2.End, Unitize=False)  # -> Vector, Length
vec2pt_6 = Vector2Pt(PointA=data_3, PointB=end.End, Unitize=False)  # -> Vector, Length
angle = Angle(VectorA=vec2pt_5.Vector, VectorB=vec2pt_4.Vector, Plane=data_3)  # -> Angle, Reflex
angle_2 = Angle(VectorA=vec2pt_3.Vector, VectorB=vec2pt_6.Vector, Plane=data_3)  # -> Angle, Reflex
angle_3 = Angle(VectorA=vec2pt_2.Vector, VectorB=vec2pt.Vector, Plane=data_4)  # -> Angle, Reflex
arc = Arc(Plane=data_3, Radius=R, Angle=angle.Angle)  # -> Arc, Length
arc_2 = Arc(Plane=data_3, Radius=R, Angle=angle_2.Angle)  # -> Arc, Length
arc_3 = Arc(Plane=data_4, Radius=R_2, Angle=angle_3.Angle)  # -> Arc, Length
end_4 = EndPoints(Curve=arc.Arc)  # -> Start, End
end_5 = EndPoints(Curve=arc_2.Arc)  # -> Start, End
end_6 = EndPoints(Curve=arc_3.Arc)  # -> Start, End
vec2pt_7 = Vector2Pt(PointA=data_3, PointB=end_4.Start, Unitize=False)  # -> Vector, Length
vec2pt_8 = Vector2Pt(PointA=data_3, PointB=end_5.Start, Unitize=False)  # -> Vector, Length
vec2pt_9 = Vector2Pt(PointA=data_4, PointB=end_6.Start, Unitize=False)  # -> Vector, Length
angle_4 = Angle(VectorA=vec2pt_5.Vector, VectorB=vec2pt_7.Vector, Plane=data_3)  # -> Angle, Reflex
angle_5 = Angle(VectorA=vec2pt_2.Vector, VectorB=vec2pt_9.Vector, Plane=data_4)  # -> Angle, Reflex
angle_6 = Angle(VectorA=vec2pt_3.Vector, VectorB=vec2pt_8.Vector, Plane=data_3)  # -> Angle, Reflex
rotate = Rotate(Geometry=arc_3.Arc, Angle=expr("-x", angle_5.Angle), Plane=data_4)  # -> Geometry, Transform
rotate_2 = Rotate(Geometry=arc.Arc, Angle=expr("-x", angle_4.Angle), Plane=data_3)  # -> Geometry, Transform
rotate_3 = Rotate(Geometry=arc_2.Arc, Angle=expr("-x", angle_6.Angle), Plane=data_3)  # -> Geometry, Transform
G_2 = ClusterOutput(rotate.Geometry)
G_3 = ClusterOutput(rotate_3.Geometry)
G_4 = ClusterOutput(rotate_2.Geometry)

# ==== cluster Cluster_2
C = ClusterInput()
G = ClusterInput()
flip = FlipCurve(Curve=C, Guide=G)  # -> Curve, Flag
item = ListItem(List=flip.Curve, Index=0, Wrap=True)  # -> Item, Item1, Item2
data = ClusterInput()
R = ClusterInput()
data_2 = ClusterInput()
R_2 = ClusterInput()
end = EndPoints(Curve=item.Item2)  # -> Start, End
end_2 = EndPoints(Curve=item.Item)  # -> Start, End
end_3 = EndPoints(Curve=item.Item1)  # -> Start, End
data_3 = Data(data)
data_4 = Data(data_2)
vec2pt = Vector2Pt(PointA=data_4, PointB=end_3.Start, Unitize=False)  # -> Vector, Length
vec2pt_2 = Vector2Pt(PointA=data_4, PointB=end_2.Start, Unitize=False)  # -> Vector, Length
vec2pt_3 = Vector2Pt(PointA=data_3, PointB=end_3.End, Unitize=False)  # -> Vector, Length
vec2pt_4 = Vector2Pt(PointA=data_3, PointB=end.End, Unitize=False)  # -> Vector, Length
angle = Angle(VectorA=vec2pt_3.Vector, VectorB=vec2pt_4.Vector, Plane=data_3)  # -> Angle, Reflex
angle_2 = Angle(VectorA=vec2pt_2.Vector, VectorB=vec2pt.Vector, Plane=data_4)  # -> Angle, Reflex
arc = Arc(Plane=data_3, Radius=R, Angle=angle.Angle)  # -> Arc, Length
arc_2 = Arc(Plane=data_4, Radius=R_2, Angle=angle_2.Angle)  # -> Arc, Length
end_4 = EndPoints(Curve=arc.Arc)  # -> Start, End
end_5 = EndPoints(Curve=arc_2.Arc)  # -> Start, End
vec2pt_5 = Vector2Pt(PointA=data_3, PointB=end_4.Start, Unitize=False)  # -> Vector, Length
vec2pt_6 = Vector2Pt(PointA=data_4, PointB=end_5.Start, Unitize=False)  # -> Vector, Length
angle_3 = Angle(VectorA=vec2pt_2.Vector, VectorB=vec2pt_6.Vector, Plane=data_4)  # -> Angle, Reflex
angle_4 = Angle(VectorA=vec2pt_3.Vector, VectorB=vec2pt_5.Vector, Plane=data_3)  # -> Angle, Reflex
rotate = Rotate(Geometry=arc_2.Arc, Angle=expr("-x", angle_3.Angle), Plane=data_4)  # -> Geometry, Transform
rotate_2 = Rotate(Geometry=arc.Arc, Angle=expr("-x", angle_4.Angle), Plane=data_3)  # -> Geometry, Transform
G_2 = ClusterOutput(rotate.Geometry)
G_3 = ClusterOutput(rotate_2.Geometry)
