# Grasshopper definition gearDUALS.gh (Grasshopper 1.0.4)
# plug-ins: Pufferfish

number_slider = Slider(38, range=0..100)
addition = Addition(A=Slider(7, range=0..100), B=number_slider)
shaft_radius = Slider(2.5, range=0..10)
number_slider_2 = Slider(48, range=0..100)
pt = ConstructPoint(XCoordinate=0, YCoordinate=addition, ZCoordinate=0)
subtraction = Subtraction(A=addition, B=number_slider)
cir = Circle(Plane=PlaneXY(0, 0, 0), Radius=number_slider)
pt_2 = ConstructPoint(XCoordinate=0, YCoordinate=Slider(200, range=0..200), ZCoordinate=0)
Y = UnitY(Factor=number_slider_2)
cir_2 = Circle(Plane=pt, Radius=subtraction)
geo = Geometry([cir, cir_2])
move = Move(Geometry=pt_2, Motion=Y)  # -> Geometry, Transform
number_slider_3 = Slider(38, range=0..100)
shaft_radius_2 = Slider(2.5, range=0..10)
number_slider_4 = Slider(5, range=0..10)
gear_2d = Gears(
    A=geo,
    y=Slider(15, range=0..100),
    p=Slider(22.5, range=14.5..22.5),
    A_2=Slider(1.1, range=1..1.25),
    A_3=Slider(1.25, range=1.25..1.3))  # -> C, L, B, W
number_slider_5 = Slider(8, range=0..10)
addition_2 = Addition(A=Slider(10, range=0..10), B=number_slider_5)
pt_3 = ConstructPoint(XCoordinate=0, YCoordinate=0, ZCoordinate=number_slider_4)
subtraction_2 = Subtraction(A=number_slider_2, B=number_slider_3)
cir_3 = Circle(Plane=pt_2, Radius=number_slider_3)
Z = UnitZ(Factor=number_slider_4)
cir_4 = Circle(Plane=pt_3, Radius=addition_2)
cir_5 = Circle(Plane=PlaneXY(0, 0, 0), Radius=Slider(4.5, range=0..10))
linedim = LineDimension(Line=gear_2d.W, Text="{0:0.00}", Size=1)
cir_6 = Circle(Plane=move.Geometry, Radius=subtraction_2)
polygon = Polygon(Plane=pt_3, Radius=number_slider_5, Segments=Slider(6, range=0..10), FilletRadius=0)  # -> Polygon, Length
geo_2 = Geometry([cir_3, cir_6])
bang = ExplodeTree(Data=gear_2d.B)  # -> Branch0, Branch1
boundary = BoundarySurfaces(Edges=[polygon.Polygon, cir_4])
Z_2 = UnitZ(Factor=Slider(7, range=0..100))
number_slider_6 = Slider(5, range=0..10)
Z_3 = UnitZ(Factor=number_slider_6)
move_2 = Move(Geometry=pt_2, Motion=Z_3)  # -> Geometry, Transform
gear_2d_2 = Gears(
    A=geo_2,
    y=Slider(30, range=0..100),
    p=Slider(22.5, range=14.5..22.5),
    A_2=Slider(1.1, range=1..1.25),
    A_3=Slider(1.25, range=1.25..1.3))  # -> C, L, B, W
cir_7 = Circle(Plane=bang.Branch0, Radius=shaft_radius)
number_slider_7 = Slider(8, range=0..10)
addition_3 = Addition(A=Slider(10, range=0..10), B=number_slider_7)
boundary_2 = BoundarySurfaces(Edges=gear_2d.C)
extr = Extrude(Base=flatten(boundary_2), Direction=Z)
extr_2 = Extrude(Base=flatten(boundary), Direction=Z_2)
boundary_3 = BoundarySurfaces(Edges=[cir_7, cir_5])
Z_4 = UnitZ(Factor=Slider(20, range=0..100))
offcrv = OffsetCurve(Curve=cir_7, Distance=Slider(3, range=0..10), Plane=PlaneXY(0, 0, 0), BothSides=False, Kinks=0, CapType=1)
multiplication = Multiplication(A=number_slider_4, B="2")
Z_5 = UnitZ(Factor=number_slider_6)
cir_8 = Circle(Plane=move_2.Geometry, Radius=addition_3)
cir_9 = Circle(Plane=pt_2, Radius=Slider(4.5, range=0..10))
linedim_2 = LineDimension(Line=gear_2d_2.W, Text="{0:0.00}", Size=1)
polygon_2 = Polygon(Plane=move_2.Geometry, Radius=number_slider_7, Segments=Slider(6, range=0..10), FilletRadius=0)  # -> Polygon, Length
extr_3 = Extrude(Base=flatten(boundary_3), Direction=Z_4)
boundary_4 = BoundarySurfaces(Edges=offcrv)
Z_6 = UnitZ(Factor=multiplication)
bang_2 = ExplodeTree(Data=gear_2d_2.B)  # -> Branch0, Branch1
boundary_5 = BoundarySurfaces(Edges=[polygon_2.Polygon, cir_8])
extr_4 = Extrude(Base=flatten(boundary_4), Direction=Z_6)
Z_7 = UnitZ(Factor=Slider(7, range=0..100))
cir_10 = Circle(Plane=bang_2.Branch0, Radius=shaft_radius_2)
merge = Merge(Data1=extr_3)
boundary_6 = BoundarySurfaces(Edges=gear_2d_2.C)
extr_5 = Extrude(Base=flatten(boundary_6), Direction=Z_5)
extr_6 = Extrude(Base=flatten(boundary_5), Direction=Z_7)
entwine = Entwine(Branch00=extr_4, Branch01=extr_2, FlattenInputs=True)  # -> simplify(Result)
boundary_7 = BoundarySurfaces(Edges=[cir_10, cir_9])
Z_8 = UnitZ(Factor=Slider(20, range=0..100))
offcrv_2 = OffsetCurve(Curve=cir_10, Distance=Slider(3, range=0..10), Plane=PlaneXY(0, 0, 0), BothSides=False, Kinks=0, CapType=1)
multiplication_2 = Multiplication(A=number_slider_6, B="2")
merge_2 = Merge(Data1=simplify(graft(extr)), Data2=entwine)
extr_7 = Extrude(Base=flatten(boundary_7), Direction=Z_8)
boundary_8 = BoundarySurfaces(Edges=offcrv_2)
Z_9 = UnitZ(Factor=multiplication_2)
extr_8 = Extrude(Base=flatten(boundary_8), Direction=Z_9)
sunion = SolidUnion(Breps=merge_2)
merge_3 = Merge(Data1=extr_7)
entwine_2 = Entwine(Branch00=extr_8, Branch01=extr_6, FlattenInputs=True)  # -> simplify(Result)
sdiff = SolidDifference(BrepsA=flatten(sunion), BrepsB=merge)
merge_4 = Merge(Data1=simplify(graft(extr_5)), Data2=entwine_2)
sunion_2 = SolidUnion(Breps=merge_4)
sdiff_2 = SolidDifference(BrepsA=flatten(sunion_2), BrepsB=merge_3)
item = ListItem(List=sdiff_2, Index=0, Wrap=True)  # -> Item, Item1
bbox = BoundingBox(Content=item.Item1, Plane=PlaneXY(0, 0, 0))  # -> Box, Box_2
debox = DeconstructBox(Box=bbox.Box)  # -> Plane, X, Y, Z
boxprop = BoxProperties(Box=bbox.Box)  # -> Center, Diagonal, Area, Volume, Degeneracy
dedomain = DeconstructDomain(Domain=debox.X)  # -> Start, End
subtraction_3 = Subtraction(A=dedomain.End, B=dedomain.Start)
panel = Panel(subtraction_3)

# ==== cluster Gears: Creat 2D Gears
A = ClusterInput()
y = ClusterInput()
p = ClusterInput()
A_2 = ClusterInput()
A_3 = ClusterInput()
lng = ListLength(List=A)  # -> expr("x-1", Length)
darc = DeconstructArc(Arc=A)  # -> BasePlane, Radius, Angle
expression = Expression(x=lng, Expression="if(x = 0, 0 ,1)")
expression_2 = Expression(x=lng, Expression="if(x = 0, 1 ,x)")
range = Range(Domain=lng, Steps=lng)
sort = SortList(Keys=darc.Radius, ValuesA=A)  # -> Keys, ValuesA
sort_2 = SortList(Keys=darc.Radius)  # -> Keys, ValuesA
darc_2 = DeconstructArc(Arc=sort.ValuesA)  # -> BasePlane, Radius, Angle
item = ListItem(List=sort.Keys, Index=0, Wrap=True)
filter = StreamFilter(Gate=expression, Stream0=expression_2, Stream1=range)
moudule = Evaluate(F="(x*2)/y", x=item, y=y)
eval = Evaluate(F="(x*2)/y", x=darc_2.Radius, y=moudule)
item_2 = ListItem(List=sort.ValuesA, Index=filter, Wrap=True)  # -> graft(Item)
item_3 = ListItem(List=eval, Index=filter, Wrap=True)  # -> graft(Item)
eval_2 = Evaluate(F="(x)*m", x=A_2, m=moudule)
eval_3 = Evaluate(F="(x)*m", x=A_2, m=moudule)
darc_3 = DeconstructArc(Arc=item_2)  # -> BasePlane, Radius, Angle
python = PythonScript(c=item_2, x=eval_2, y=eval_3, p=p)  # -> out, simplify(a), b, simplify(c), d
# ---------- python: Python ----------
import Rhino as rh
import Rhino.Geometry as rg
import math as m
import Grasshopper as gh


"""place a new circle"""
def newCir(c,ag,x):
    
    addR = x
    
    
    """Trigonmetry of bevel gear"""
    cirPl = rg.Circle.Plane.GetValue(c)
    cirOr = cirPl.Origin
    cirZ = cirPl.ZAxis
    cirR = rg.Circle.Radius.GetValue(c)
    
    r = cirR + addR
    
    
    
    return rg.Circle(cirPl,r), r


a ,b = newCir(c,d,x)
c, d = newCir(c,d,-y)
print a
# ---------- end python ----------
involute = PythonScript(r=darc_3.Radius, p=p)  # -> b
# ---------- involute: Python ----------
import math
import Rhino as rh

c = 0.019
t=0
ptList = []
a = math.cos(math.radians(p))*r
for i in range(0,50):
    t += c
    x = a * (math.cos(t) + t * math.sin(t))
    y = a * (math.sin(t) - t * math.cos(t))
    z = 0
    pts = rh.Geometry.Point3d(x,y,z)
    ptList.append(pts)

b = rh.Geometry.PolylineCurve.CreateInterpolatedCurve(ptList,3)
# ---------- end involute ----------
range_2 = Range(Domain="360", Steps=item_3)
orient = Orient(Geometry=involute, Source=PlaneXY(0, 0, 0), Target=darc_3.BasePlane)  # -> Geometry, Transform
multiplication = Multiplication(A=A_2, B="10")
multiplication_2 = Multiplication(A=A_3, B="10")
lng_2 = ListLength(List=range_2)
ext = ExtendCurve(Curve=orient.Geometry, Type=0, Start=multiplication, End=multiplication_2)
split = SplitList(List=range_2, Index=expr("x-1", lng_2))  # -> ListA, ListB
divide = DivideCurve(Curve=item_2, Count=expr("x-1", lng_2), Kinks=False)  # -> Points, Tangents, Parameters
item_4 = ListItem(List=divide.Parameters, Index=0, Wrap=True)  # -> Item, Item1
data = Data(darc_3.BasePlane)
mcx = MultipleCurves(Curves=[item_2, ext])  # -> Points, IndexA, IndexB, ParamA, ParamB
eval_4 = Evaluate(F="(x+y)/4", x=item_4.Item, y=item_4.Item1)
addition = Addition(A=mcx.ParamA, B=eval_4)
eval_5 = EvaluateCurve(Curve=item_2, Parameter=addition)  # -> Point, Tangent, Angle
trim = TrimWithRegions(Curve=ext, Regions=[python.a, python.c])  # -> Inside, Outside
move = Move(Geometry=data, Motion=data)  # -> Geometry, Transform
ln = Line(StartPoint=move.Geometry, EndPoint=data)
item_5 = ListItem(List=trim.Inside, Index=1, Wrap=True)  # -> simplify(Item)
lnpt = LinePt(Line=ln, Point=eval_5.Point)
mirror = Mirror(Geometry=item_5, Plane=lnpt)  # -> simplify(Geometry), Transform
rotate = Rotate(Geometry=item_5, Angle=degrees(split.ListA), Plane=data)  # -> simplify(Geometry), Transform
rotate_2 = Rotate(Geometry=mirror.Geometry, Angle=degrees(split.ListA), Plane=data)  # -> simplify(Geometry), Transform
lng_3 = ListLength(List=rotate.Geometry)
weave = Weave(Pattern=[0, 1], Stream0=rotate.Geometry, Stream1=rotate_2.Geometry, NullGaps=False)
cluster = Cluster(data_2=python.a, data=python.c, R_2=python.b, R=python.d, C=weave, G=ln)  # -> G_2, G_3
item_6 = ListItem(List=cluster.G_2, Index=0, Wrap=True)
end = EndPoints(Curve=item_6)  # -> Start, End
end_2 = EndPoints(Curve=mirror.Geometry)  # -> Start, End
rotate_3 = Rotate(Geometry=cluster.G_2, Angle=degrees(split.ListA), Plane=data)  # -> simplify(Geometry), Transform
rotate_4 = Rotate(Geometry=cluster.G_3, Angle=degrees(split.ListA), Plane=data)  # -> simplify(Geometry), Transform
ln_2 = Line(StartPoint=end.Start, EndPoint=end.End)  # -> flatten(Line)
ln_3 = Line(StartPoint=end_2.Start, EndPoint=end_2.End)  # -> flatten(Line)
join = JoinCurves(Curves=[weave, rotate_3.Geometry, rotate_4.Geometry], Preserve=False)  # -> simplify(Curves)
weave_2 = Weave(Pattern=[0, 1], Stream0=ln_2, Stream1=ln_3, NullGaps=False)
B = ClusterOutput(darc_3.BasePlane)
W = ClusterOutput(weave_2)
C = ClusterOutput(join)
L = ClusterOutput(lng_3)

# ==== cluster Cluster
C = ClusterInput()
G = ClusterInput()
flip = FlipCurve(Curve=C, Guide=G)  # -> Curve, Flag
item = ListItem(List=flip.Curve, Index=0, Wrap=True)  # -> Item, Item1, Item2
data = ClusterInput()
R = ClusterInput()
data_2 = ClusterInput()
R_2 = ClusterInput()
end = EndPoints(Curve=item.Item2)  # -> Start, End
end_2 = EndPoints(Curve=item.Item)  # -> Start, End
end_3 = EndPoints(Curve=item.Item1)  # -> Start, End
data_3 = Data(data)
data_4 = Data(data_2)
vec2pt = Vector2Pt(PointA=data_4, PointB=end_3.Start, Unitize=False)  # -> Vector, Length
vec2pt_2 = Vector2Pt(PointA=data_4, PointB=end_2.Start, Unitize=False)  # -> Vector, Length
vec2pt_3 = Vector2Pt(PointA=data_3, PointB=end_3.End, Unitize=False)  # -> Vector, Length
vec2pt_4 = Vector2Pt(PointA=data_3, PointB=end.End, Unitize=False)  # -> Vector, Length
angle = Angle(VectorA=vec2pt_3.Vector, VectorB=vec2pt_4.Vector, Plane=data_3)  # -> Angle, Reflex
angle_2 = Angle(VectorA=vec2pt_2.Vector, VectorB=vec2pt.Vector, Plane=data_4)  # -> Angle, Reflex
arc = Arc(Plane=data_3, Radius=R, Angle=angle.Angle)  # -> Arc, Length
arc_2 = Arc(Plane=data_4, Radius=R_2, Angle=angle_2.Angle)  # -> Arc, Length
end_4 = EndPoints(Curve=arc.Arc)  # -> Start, End
end_5 = EndPoints(Curve=arc_2.Arc)  # -> Start, End
vec2pt_5 = Vector2Pt(PointA=data_3, PointB=end_4.Start, Unitize=False)  # -> Vector, Length
vec2pt_6 = Vector2Pt(PointA=data_4, PointB=end_5.Start, Unitize=False)  # -> Vector, Length
angle_3 = Angle(VectorA=vec2pt_2.Vector, VectorB=vec2pt_6.Vector, Plane=data_4)  # -> Angle, Reflex
angle_4 = Angle(VectorA=vec2pt_3.Vector, VectorB=vec2pt_5.Vector, Plane=data_3)  # -> Angle, Reflex
rotate = Rotate(Geometry=arc_2.Arc, Angle=expr("-x", angle_3.Angle), Plane=data_4)  # -> Geometry, Transform
rotate_2 = Rotate(Geometry=arc.Arc, Angle=expr("-x", angle_4.Angle), Plane=data_3)  # -> Geometry, Transform
G_2 = ClusterOutput(rotate.Geometry)
G_3 = ClusterOutput(rotate_2.Geometry)
