# Grasshopper definition ISO_metrics_screw_threads.gh (Grasshopper 0.9.76)

# ----
# List of common combinations
# of nominal diameter and pitch:
# 
# M Nominal Diameter x Pitch (mm)
# Sources:
# 
# http://www.roymech.co.uk/Useful_Tables/Screws/Thread_tol.html#Fundamental
# 
# http://mdmetric.com/tech/M-thead%20600.htm
thread_designation = Panel("""M0.25x0.075
M0.3x0.08
M0.3x0.09
M0.35x0.09
M0.4x0.1
M0.45x0.1
M0.5x0.125
M0.55x0.125
M0.6x0.15
M0.7x0.175
M0.8x0.2
M0.9x0.225
M1x0.25
M1x0.2
M1.1x0.25
M1.1x0.2
M1.2x0.25
M1.2x0.2
M1.4x0.3
M1.4x0.2
M1.6x0.35
M1.6x0.3
M1.6x0.2
M1.7x0.35
M1.8x0.35
M1.8x0.2
M2x0.4
M2x0.25
M2.2x0.45
M2.2x0.25
M2.3x0.45
M2.3x0.4
M2.5x0.45
M2.5x0.35
M2.6x0.45
M3x0.5
M3x0.35
M3.5x0.6
M3.5x0.35
M4x0.7
M4x0.5
M4.5x0.75
M4.5x0.5
M5x0.8
M5x0.5
M5.5x0.5
M6x1
M6x0.8
M6x0.75
M6x0.7
M6x0.5
M7x1
M7x0.75
M7x0.5
M8x1.25
M8x1
M8x0.8
M8x0.75
M8x0.5
M9x1.25
M9x1
M9x0.75
M9x0.5
M10x1.5
M10x1.25
M10x1.12
M10x1
M10x0.75
M10x0.5
M11x1.5
M11x1
M11x0.75
M11x0.5
M12x1.75
M12x1.5
M12x1.25
M12x1
M12x0.75
M12x0.5
M14x2
M14x1.5
M14x1.25
M14x1
M14x0.75
M14x0.5
M15x1.5
M15x1
M16x2
M16x1.6
M16x1.5
M16x1.25
M16x1
M16x0.75
M16x0.5
M17x1.5
M17x1
M18x2.5
M18x2
M18x1.5
M18x1.25
M18x1
M18x0.75
M18x0.5
M20x2.5
M20x2
M20x1.5
M20x1
M20x0.75
M20x0.5
M22x3
M22x2.5
M22x2
M22x1.5
M22x1
M22x0.75
M22x0.5
M24x3
M24x2.5
M24x2
M24x1.5
M24x1
M24x0.75
M25x2
M25x1.5
M25x1
M26x1.5
M27x3
M27x2
M27x1.5
M27x1
M27x0.75
M28x2
M28x1.5
M28x1
M30x3.5
M30x3
M30x2.5
M30x2
M30x1.5
M30x1
M30x0.75
M32x2
M32x1.5
M33x3.5
M33x3
M33x2
M33x1.5
M33x1
M33x0.75
M35x1.5
M36x4
M36x3
M36x2
M36x1.5
M36x1
M38x1.5
M39x4
M39x3
M39x2
M39x1.5
M39x1
M40x3
M40x2.5
M40x2
M40x1.5
M42x4.5
M42x4
M42x3
M42x2
M42x1.5
M42x1
M45x4.5
M45x4
M45x3
M45x2
M45x1.5
M45x1
M48x5
M48x4
M48x3
M48x2
M48x1.5
M50x4
M50x3
M50x2
M50x1.5
M52x5
M52x4
M52x3
M52x2
M52x1.5
M55x4
M55x3
M55x2
M55x1.5
M56x5.5
M56x4
M56x3
M56x2
M56x1.5
M56x1
M58x4
M58x3
M58x2
M58x1.5
M60x5.5
M60x4
M60x3
M60x2
M60x1.5
M60x1
M62x4
M62x3
M62x2
M62x1.5
M63x1.5
M64x6
M64x5.5
M64x4
M64x3
M64x2
M64x1.5
M64x1
M65x4
M65x3
M65x2
M65x1.5
M68x6
M68x4
M68x3
M68x2
M68x1.5
M68x1
M70x6
M70x4
M70x3
M70x2
M70x1.5
M72x6
M72x4
M72x3
M72x2
M72x1.5
M72x1
M75x6
M75x4
M75x3
M75x2
M75x1.5
M76x6
M76x4
M76x3
M76x2
M76x1.5
M76x1
M78x2
M80x6
M80x4
M80x3
M80x2
M80x1.5
M80x1
M82x2
M85x6
M85x4
M85x3
M85x2
M85x1.5
M90x6
M90x4
M90x3
M90x2
M90x1.5
M95x6
M95x4
M95x3
M95x2
M95x1.5
M100x6
M100x4
M100x3
M100x2
M100x1.5
M105x6
M105x4
M105x3
M105x2
M105x1.5
M110x6
M110x4
M110x3
M110x2
M110x1.5
M115x6
M115x4
M115x3
M115x2
M115x1.5
M120x6
M120x4
M120x3
M120x2
M120x1.5
M125x8
M125x6
M125x4
M125x3
M125x2
M125x1.5
M130x8
M130x6
M130x4
M130x3
M130x2
M130x1.5
M135x6
M135x4
M135x3
M135x2
M135x1.5
M140x8
M140x6
M140x4
M140x3
M140x2
M140x1.5
M145x6
M145x4
M145x3
M145x2
M145x1.5
M150x8
M150x6
M150x4
M150x3
M150x2
M150x1.5
M155x6
M155x4
M155x3
M155x2
M160x8
M160x6
M160x4
M160x3
M160x2
M165x6
M165x4
M165x3
M165x2
M170x8
M170x6
M170x4
M170x3
M170x2
M175x6
M175x4
M175x3
M175x2
M180x8
M180x6
M180x4
M180x3
M180x2
M185x6
M185x4
M185x3
M185x2
M190x8
M190x6
M190x4
M190x3
M190x2
M195x6
M195x4
M195x3
M195x2
M200x8
M200x6
M200x4
M200x3
M200x2
M205x6
M205x4
M205x3
M205x2
M210x8
M210x6
M210x4
M210x3
M210x2
M215x6
M215x4
M215x3
M220x8
M220x6
M220x4
M220x3
M220x2
M225x6
M225x4
M225x3
M225x2
M230x6
M230x4
M230x3
M230x2
M235x6
M235x4
M235x3
M240x8
M240x6
M240x4
M240x3
M240x2
M245x6
M245x4
M245x3
M245x2
M250x8
M250x6
M250x4
M250x3
M250x2
M255x6
M255x4
M255x3
M260x8
M260x6
M260x4
M260x3
M265x6
M265x4
M265x3
M270x6
M270x4
M270x3
M275x6
M275x4
M275x3
M280x8
M280x6
M280x4
M280x3
M285x6
M285x4
M285x3
M290x6
M290x4
M290x3
M295x6
M295x4
M295x3
M300x8
M300x6
M300x4
M300x3
M310x6
M310x4
M320x6
M320x4
M330x6
M330x4
M340x6
M340x4
M350x6
M350x4
M360x6
M360x4
M370x6
M370x4
M380x6
M380x4
M390x6
M390x4
M400x6
M400x4
M410x6
M420x6
M430x6
M440x6
M450x6
M460x6
M470x6
M480x6
M490x6
M500x6
M510x6
M520x6
M530x6
M540x6
M550x6
M560x6
M570x6
M580x6
M590x6
M600x6""")

# ----
# INTERFACE
# 1. Select the nominal diameter and pitch (mm) with the sliders.
# Values snap to common values but can also be customised.
# For common combinations of diameter and pitch, see list on the left hand side panel.
# 2. Select the amount of clearance with the sliders.
# For values=0, the minimal fundamental deviation (allowance) is given.
# The clearance can be increased, for male and female threads, from 0 to 1 to move within the tolerance zone.
# 3. See previsualisation.
# Sectioned model to preview the results.
# 4. Select the number of turns with the slider.
# 5. Select the chamfer angle.
# 6. Results.
# Bake as desired.
nominal_diameter_snap_to_normalised_valu = Slider(9, range=0.25..600)  # "Nominal Diameter (snap to normalised values)"
pitch_snap_to_normalised_values = Slider(1.25, range=0.07..8)
percentage_of_male_tolerance_to_increase = Slider(0.5, range=0..1)  # "Percentage of Male Tolerance to increase the Clearance"
percentage_of_female_tolerance_to_increa = Slider(0.5, range=0..1)  # "Percentage of Female Tolerance to increase the Clearance"
number_of_turns = Slider(10, range=1..200)
chamfer_angle = Slider(45, range=0..89)
male_thread = ColourSwatch(SwatchColor=RGB(75, 102, 55))
female_thread = ColourSwatch(SwatchColor=RGB(84, 83, 166))
pitch = Panel(pitch_snap_to_normalised_values)
nominal_diameter = Panel(nominal_diameter_snap_to_normalised_valu)

num = Number(pitch_snap_to_normalised_values)
num_2 = Number(nominal_diameter_snap_to_normalised_valu)
int = Integer(number_of_turns)

# ----
# Profiles
panel = Panel("D/2-3^0.5*5*P/16")
f_x_y = F2(Function=panel, X=num_2, Y=num)
f_x_y_2 = F2(Function="D/2+P/(16*3^0.5)", X=num_2, Y=num)
f_x_y_3 = F2(Function="r-P/(8*3^0.5)", X=f_x_y, Y=num)
pt_2 = ConstructPoint(XCoordinate=expr("x/4", num), YCoordinate=0, ZCoordinate=f_x_y)
pt_4 = ConstructPoint(XCoordinate=expr("11*x/16", num), YCoordinate=0, ZCoordinate=expr("x/2", num_2))
pt_3 = ConstructPoint(XCoordinate=expr("9*x/16", num), YCoordinate=0, ZCoordinate=expr("x/2", num_2))
pt_5 = ConstructPoint(XCoordinate=num, YCoordinate=0, ZCoordinate=f_x_y)
pt_1 = ConstructPoint(XCoordinate=0, YCoordinate=0, ZCoordinate=f_x_y)
pt_1_2 = ConstructPoint(XCoordinate=expr("x/8", num), YCoordinate=0, ZCoordinate=f_x_y_3)
pt_3_4 = ConstructPoint(XCoordinate=expr("5*x/8", num), YCoordinate=0, ZCoordinate=f_x_y_2)
series = Series(Start=0, Step=num, Count=expr("x+1", int))
arc = Arc3Pt(PointA=pt_3, PointB=pt_3_4, PointC=pt_4)  # -> Arc, Plane, Radius
pline = PolyLine(Vertices=[pt_4, pt_5], Closed=False)
pline_2 = PolyLine(Vertices=[pt_2, pt_3, pt_4, pt_5], Closed=False)
pline_3 = PolyLine(Vertices=[pt_1, pt_2, pt_3], Closed=False)
arc_2 = Arc3Pt(PointA=pt_1, PointB=pt_1_2, PointC=pt_2)  # -> Arc, Plane, Radius
join = JoinCurves(Curves=[arc_2.Arc, pline_2], Preserve=False)
join_2 = JoinCurves(Curves=[arc.Arc, pline_3, pline], Preserve=False)
X = UnitX(Factor=series)
move = Move(Geometry=join_2, Translation=X)
move_2 = Move(Geometry=join, Translation=X)

expression = Expression(x=num, y=int, Expression="(x*y)")
expression_2 = Expression(x=num, y=int, Expression="(x*y)")
yz = YZPlane(Origin=Point(0, 0, 0))
Z = UnitZ(Factor=f_x_y_3)
yz_2 = YZPlane(Origin=Point(0, 0, 0))
cyl = Cylinder(Base=yz, Radius=Z, Length=expression)
cyl_2 = Cylinder(Base=yz_2, Radius=expr("x/2", num_2), Length=expression_2)
cap = CapHoles(Brep=cyl)
cap_2 = CapHoles(Brep=cyl_2)

# ----
# Cylinder
internal_cylinder = Brep(cap)

# ---- group: Common
pitch_2 = Number([0.075, 0.08, 0.09, 0.1, 0.125, 0.15, 0.175, 0.2, 0.25, 0.3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])
num_3 = Number(nominal_diameter_snap_to_normalised_valu)
subtraction = Subtraction(A=pitch_2, B=pitch_snap_to_normalised_values)
abs = Absolute(Value=subtraction)
sort = SortList(Keys=abs, ValuesA=pitch_2)  # -> Keys, ValuesA
item = ListItem(List=sort.ValuesA, Index=0, Wrap=True)
index = ItemIndex(List=pitch_2, Item=item)
item_2 = ListItem(List=pitch_2, Index=index, Wrap=True)

# ----
# Female thread
female_fd = Number([0, 0, 0, 0, 0, 0, 0, 0, 0, 0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])
female_tolerance = Number([0.021, 0.021, 0.024, 0.025, 0.029, 0.033, 0.037, 0.042, 0.063, 0.085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])
item_3 = ListItem(List=female_fd, Index=index, Wrap=True)
item_4 = ListItem(List=female_tolerance, Index=index, Wrap=True)
male_max = Evaluate(F="ND+FD", ND=num_3, FD=item_3)
min_female_diameter = Panel(male_max)
eval = Evaluate(F="MMax+T", MMax=male_max, T=item_4)
max_female_diameter = Panel(eval)
eval_2 = Evaluate(F="x+(T*y)", x=male_max, T=item_4, y=percentage_of_female_tolerance_to_increa)

# ----
# Male thread
male_tolerance = Number([0.015, 0.016, 0.017, 0.018, 0.021, 0.024, 0.027, 0.056, 0.067, 0.075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])
male_fd = Number([0, 0, 0, 0, 0, 0, 0, 0.017, 0.018, 0.018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])
item_5 = ListItem(List=male_fd, Index=index, Wrap=True)
item_6 = ListItem(List=male_tolerance, Index=index, Wrap=True)
male_max_2 = Evaluate(F="ND-FD", ND=num_3, FD=item_5)
max_male_diameter = Panel(male_max_2)
eval_3 = Evaluate(F="MMax-T", MMax=male_max_2, T=item_6)
min_male_diameter = Panel(eval_3)
eval_4 = Evaluate(F="x-(T*y)", x=male_max_2, T=item_6, y=percentage_of_male_tolerance_to_increase)

# ---- group: FFF 3D PRINTING DIAMETERS
nut_diameter = Number(eval_2)
bolt_diameter = Number(eval_4)

# ----
# Fundamental deviations and tolerances for male and female diameters
# GENERAL USE THREADS (CLASS 6G/6H)
# VARIABLES
# ND: Nominal diameter
# P: Pitch
# MT: Male tolerance
# FT: Female tolerance
# MFD: Male fundamental deviation
# FFD: Female fundamental deviation
# d: Male diameter
# D: Female diameter
# Sources:
# 
# http://www.roymech.co.uk/Useful_Tables/Screws/Thread_tol.html#Fundamental
# 
# http://mdmetric.com/tech/M-thead%20600.htm
eval_5 = Evaluate(F="(x-y)/2", x=nominal_diameter_snap_to_normalised_valu, y=bolt_diameter)
eval_6 = Evaluate(F="(y-x)/2", x=nominal_diameter_snap_to_normalised_valu, y=nut_diameter)
Z_2 = UnitZ(Factor=eval_5)
Z_3 = UnitZ(Factor=eval_6)
rev = Reverse(Vector=Z_2)

# ----
# Profiles and surfaces
panel_2 = Panel("2*pi")
eval_7 = Evaluate(F="(D-2*x)/2-3^0.5*5*P/16", x=eval_5, D=num_2, P=num)

# ----
# Bolt profile
# (male)
join_3 = JoinCurves(Curves=move_2, Preserve=False)
move_3 = Move(Geometry=join_3, Motion=rev)  # -> Geometry, Transform

# ----
# Nut profile
# (female)
join_4 = JoinCurves(Curves=move, Preserve=False)
move_4 = Move(Geometry=join_4, Motion=Z_3)  # -> Geometry, Transform

# ----
# Helix
helix_points_number = Slider(36, range=10..300)
div = Division(FirstNumber=panel_2, SecondNumber=expr("x-1", helix_points_number))
div_2 = Division(FirstNumber=num, SecondNumber=expr("x-1", helix_points_number))
series_2 = Series(Start=0, Step=div, Count=helix_points_number)
series_3 = Series(Start=0, Step=div_2, Count=helix_points_number)
sin = Sine(Input=series_2)
cos = Cosine(Input=series_2)
mult = Multiplication(FirstNumber=eval_7, SecondNumber=expr("x*-1", sin))
mult_2 = Multiplication(FirstNumber=eval_7, SecondNumber=cos)
pt = ConstructPoint(XCoordinate=series_3, YCoordinate=mult, ZCoordinate=mult_2)
pt_6 = ConstructPoint(XCoordinate=0, YCoordinate=0, ZCoordinate=0)
pt_7 = ConstructPoint(XCoordinate=num, YCoordinate=0, ZCoordinate=0)
intcrv = Interpolate(Vertices=pt, Degree=3, Periodic=False)  # -> Curve, Length, Domain
ln = Line(StartPoint=pt_6, EndPoint=pt_7)
railrev = RailRevolution(Curve=move_3.Geometry, Rail=intcrv.Curve, Axis=ln, Scale=False)
railrev_2 = RailRevolution(Curve=move_4.Geometry, Rail=intcrv.Curve, Axis=ln, Scale=False)
internal_female = BrepJoin(Breps=railrev_2)  # -> Breps, Closed
external_male = BrepJoin(Breps=railrev)  # -> Breps, Closed

# ----
# Surfaces
# Male (bolt)
# Solid male thread with chamfer
external_male_surface = Brep(external_male.Breps)

# ----
# Female (nut)
internal_female_2 = Brep(internal_female.Breps)

# ---- group: Solid thread
# Solids and Chamfers
expression_3 = Expression(x=num, y=int, Expression="(x*(y+1))")
X_2 = UnitX(Factor=expression_3)
X_3 = UnitX(Factor=num)
ln_2 = Line(StartPoint=X_3, EndPoint=X_2)
end = EndPoints(Curve=ln_2)  # -> Start, End
yz_3 = YZPlane(Origin=end.End)
yz_4 = YZPlane(Origin=end.Start)
cir = Circle(Plane=yz_4, Radius=bolt_diameter)
cir_2 = Circle(Plane=yz_3, Radius=bolt_diameter)
boundary = BoundarySurfaces(Edges=cir)
boundary_2 = BoundarySurfaces(Edges=cir_2)
merge = Merge(Data1=boundary, Data2=boundary_2, Data3=railrev)  # -> flatten(Result)
X_4 = UnitX(Factor=expr("-x", num))
bvol = BoundaryVolume(Boundaries=merge)
move_5 = Move(Geometry=bvol, Motion=X_4)  # -> Geometry, Transform

# ----
Z_4 = UnitZ(Factor=1)
X_5 = UnitX(Factor=1)
Y = UnitY(Factor=f_x_y_3)
expression_4 = Expression(x=num, y=int, Expression="(x*y)")
vrot = Rotate(Vector=X_5, Axis=Z_4, Angle=degrees(chamfer_angle))
line = LineSDL(Start=Y, Direction=vrot, Length=expression_4)
mirror = Mirror(Geometry=line, Plane=PlaneYZ(0, 0, 0))  # -> Geometry, Transform
end_2 = EndPoints(Curve=line)  # -> Start, End
end_3 = EndPoints(Curve=mirror.Geometry)  # -> Start, End
merge_2 = Merge(Data1=end_2.Start, Data2=end_2.End, Data3=end_3.End)
X_6 = UnitX(Factor=expression_4)
pline_4 = PolyLine(Vertices=merge_2, Closed=True)
revsrf = Revolution(Curve=pline_4, Axis=Line((0, 0, 0), (126.6872814, 0, 0)), Domain=Domain(0, 6.283185307))
move_6 = Move(Geometry=revsrf, Motion=X_6)  # -> Geometry, Transform
draad = Brep(move_5.Geometry)
sint = SolidIntersection(BrepsA=draad, BrepsB=move_6.Geometry)
sint_2 = SolidIntersection(BrepsA=draad, BrepsB=revsrf)
sint_3 = SolidIntersection(BrepsA=sint_2, BrepsB=move_6.Geometry)

# ----
# Left-hand side
external_male_with_chamfered_start = Brep(sint_2)

# ----
# Right-hand side
external_male_with_chamfered_end = Brep(sint)

# ----
# Both sides
external_male_chamfered = Brep(sint_3)

# ----
# Pre-visualization
eval_8 = Evaluate(F="(x*y)+3*x", x=num, y=int)
cir_3 = Circle(Plane=yz_4, Radius=bolt_diameter)
cir_4 = Circle(Plane=yz_3, Radius=bolt_diameter)
eval_9 = Evaluate(F="x*0.6", x=num_2)
dom = ConstructDomain(DomainStart=-1, DomainEnd=eval_8)
neg = Negative(Value=eval_9)
dom_2 = ConstructDomain(DomainStart=neg, DomainEnd=eval_9)
boundary_3 = BoundarySurfaces(Edges=cir_3)
boundary_4 = BoundarySurfaces(Edges=cir_4)
box = DomainBox(Base=PlaneXY(0, 0, 0), X=dom, Y=neg, Z=dom_2)
box_2 = DomainBox(Base=PlaneXY(0, 0, 0), X=dom, Y=neg, Z=dom_2)
merge_3 = Merge(Data1=boundary_3, Data2=boundary_4, Data3=railrev_2)  # -> flatten(Result)
bvol_2 = BoundaryVolume(Boundaries=merge_3)
sdiff = SolidDifference(BrepsA=bvol_2, BrepsB=box_2)
debrep = DeconstructBrep(Brep=sdiff)  # -> Faces, Edges, Vertices
planar = IsPlanar(Surface=debrep.Faces, Interior=True)  # -> Planar, Plane
dispatch = Dispatch(List=debrep.Faces, DispatchPattern=planar.Planar)  # -> ListA, ListB

# ---- group: MALE THREAD
sdiff_2 = SolidDifference(BrepsA=external_male_with_chamfered_start, BrepsB=box)

# ---- group: FEMALE THREAD
srf = Surface(dispatch.ListB)

# ----
preview = CustomPreview(Geometry=sdiff_2, Shader=male_thread)
preview_2 = CustomPreview(Geometry=srf, Shader=female_thread)
resulting_female_diameter = Panel(nut_diameter)
resulting_male_diameter = Panel(bolt_diameter)
