# Grasshopper definition ISOmetricscrewthread.ghx (Grasshopper 0.9.56)

# ----
# ISO metric screw thread
d_mm = Slider(64, range=0..64)
pitch_mm = Slider(6, range=0..10)
number_of_turns = Slider(15, range=0..200)
chamfer_angle = Slider(45, range=0..89)

# ----
# Profiles
panel = Panel("D/2-3^0.5*5*P/16")
f_x_y = F2(Function=panel, X=d_mm, Y=pitch_mm)
f_x_y_2 = F2(Function="D/2+P/(16*3^0.5)", X=d_mm, Y=pitch_mm)
f_x_y_3 = F2(Function="r-P/(8*3^0.5)", X=f_x_y, Y=pitch_mm)
pt_3 = ConstructPoint(XCoordinate=expr("9*x/16", pitch_mm), YCoordinate=0, ZCoordinate=expr("z/2", d_mm))
pt_2 = ConstructPoint(XCoordinate=expr("x/4", pitch_mm), YCoordinate=0, ZCoordinate=f_x_y)
pt_4 = ConstructPoint(XCoordinate=expr("11*x/16", pitch_mm), YCoordinate=0, ZCoordinate=expr("z/2", d_mm))
pt_1 = ConstructPoint(XCoordinate=0, YCoordinate=0, ZCoordinate=f_x_y)
pt_5 = ConstructPoint(XCoordinate=pitch_mm, YCoordinate=0, ZCoordinate=f_x_y)
pt_1_2 = ConstructPoint(XCoordinate=expr("x/8", pitch_mm), YCoordinate=0, ZCoordinate=f_x_y_3)
pt_3_4 = ConstructPoint(XCoordinate=expr("5*x/8", pitch_mm), YCoordinate=0, ZCoordinate=f_x_y_2)
series = Series(Start=0, Step=pitch_mm, Count=expr("C+1", number_of_turns))
arc = Arc3Pt(PointA=pt_3, PointB=pt_3_4, PointC=pt_4)  # -> Arc, Plane, Radius
pline = PolyLine(Vertices=[pt_4, pt_5], Closed=False)
pline_2 = PolyLine(Vertices=[pt_2, pt_3, pt_4, pt_5], Closed=False)
pline_3 = PolyLine(Vertices=[pt_1, pt_2, pt_3], Closed=False)
arc_2 = Arc3Pt(PointA=pt_1, PointB=pt_1_2, PointC=pt_2)  # -> Arc, Plane, Radius
join = JoinCurves(Curves=[arc_2.Arc, pline_2], Preserve=False)
join_2 = JoinCurves(Curves=[arc.Arc, pline_3, pline], Preserve=False)
X = UnitX(Factor=series)
move = Move(Geometry=join_2, Translation=X)
move_2 = Move(Geometry=join, Translation=X)
join_3 = JoinCurves(Curves=move_2, Preserve=False)
join_4 = JoinCurves(Curves=move, Preserve=False)

expression = Expression(x=pitch_mm, y=number_of_turns, Expression="(x*y)")
expression_2 = Expression(x=pitch_mm, y=number_of_turns, Expression="(x*y)")
yz = YZPlane(Origin=Point(0, 0, 0))
Z = UnitZ(Factor=f_x_y_3)
yz_2 = YZPlane(Origin=Point(0, 0, 0))
cyl = Cylinder(Base=yz, Radius=Z, Length=expression)
cyl_2 = Cylinder(Base=yz_2, Radius=expr("R/2", d_mm), Length=expression_2)
cap = CapHoles(Brep=cyl)
cap_2 = CapHoles(Brep=cyl_2)

# ----
# Helix
helix_points_number = Slider(36, range=10..300)
div = Division(FirstNumber="2*pi", SecondNumber=expr("B-1", helix_points_number))
div_2 = Division(FirstNumber=pitch_mm, SecondNumber=expr("B-1", helix_points_number))
series_2 = Series(Start=0, Step=div, Count=helix_points_number)
series_3 = Series(Start=0, Step=div_2, Count=helix_points_number)
sin = Sine(Input=series_2)
cos = Cosine(Input=series_2)
mult = Multiplication(FirstNumber=f_x_y, SecondNumber=expr("B*-1", sin))
mult_2 = Multiplication(FirstNumber=f_x_y, SecondNumber=cos)
pt = ConstructPoint(XCoordinate=series_3, YCoordinate=mult, ZCoordinate=mult_2)
pt_6 = ConstructPoint(XCoordinate=0, YCoordinate=0, ZCoordinate=0)
pt_7 = ConstructPoint(XCoordinate=pitch_mm, YCoordinate=0, ZCoordinate=0)
intcrv = Interpolate(Vertices=pt, Degree=3, Periodic=False)  # -> Curve, Length, Domain
ln = Line(StartPoint=pt_6, EndPoint=pt_7)
railrev = RailRevolution(Curve=join_4, Rail=intcrv.Curve, Axis=ln, Scale=False)
railrev_2 = RailRevolution(Curve=join_3, Rail=intcrv.Curve, Axis=ln, Scale=False)
external_male = BrepJoin(Breps=railrev_2)  # -> Breps, Closed
internal_female = BrepJoin(Breps=railrev)  # -> Breps, Closed

# ----
# Iso metric screw thread generation for Rhinoceros on Grasshopper
# Laurent Delrieu 9/2011
# See preferred sizes on
# http://en.wikipedia.org/wiki/ISO_metric_screw_thread
# 
# P = Pitch (mm)
# D = Diameter (mm)
# 7 points coordinates in 2D)
# 1) {0, 		D/2-3^0.5*5P/16}
# 2) {P/8, 		D/2-3^0.5*5P/16-P/(3^0.5*8)}
# 3) {P/16, 		D-3^0.5*5P/8)/2}
# 4) {9P/16, 	D}
# 5) {5P/8,	 	D+P/(3^0.5*16)}
# 6) {11P/16, 	D}
# 7) {P,		D/2-3^0.5*5P/16}
internal_female_2 = Brep(internal_female.Breps)

# ---- group: Solid thread
expression_3 = Expression(x=pitch_mm, y=number_of_turns, Expression="(x*(y+1))")
X_2 = UnitX(Factor=expression_3)
X_3 = UnitX(Factor=pitch_mm)
ln_2 = Line(StartPoint=X_3, EndPoint=X_2)
end = EndPoints(Curve=ln_2)  # -> Start, End
yz_3 = YZPlane(Origin=end.End)
yz_4 = YZPlane(Origin=end.Start)
cir = Circle(Plane=yz_4, Radius=d_mm)
cir_2 = Circle(Plane=yz_3, Radius=d_mm)
boundary = BoundarySurfaces(Edges=cir)
boundary_2 = BoundarySurfaces(Edges=cir_2)
merge = Merge(Data1=boundary, Data2=boundary_2, Data3=railrev_2)  # -> flatten(Result)
X_4 = UnitX(Factor=expr("-F", pitch_mm))
bvol = BoundaryVolume(Boundaries=merge)
move_3 = Move(Geometry=bvol, Motion=X_4)  # -> Geometry, Transform

# ----
Z_2 = UnitZ(Factor=1)
X_5 = UnitX(Factor=1)
Y = UnitY(Factor=f_x_y_3)
expression_4 = Expression(x=pitch_mm, y=number_of_turns, Expression="(x*y)")
vrot = Rotate(Vector=X_5, Axis=Z_2, Angle=degrees(chamfer_angle))
line = LineSDL(Start=Y, Direction=vrot, Length=expression_4)
mirror = Mirror(Geometry=line, Plane=PlaneYZ(0, 0, 0))  # -> Geometry, Transform
end_2 = EndPoints(Curve=line)  # -> Start, End
end_3 = EndPoints(Curve=mirror.Geometry)  # -> Start, End
merge_2 = Merge(Data1=end_2.Start, Data2=end_2.End, Data3=end_3.End)
X_6 = UnitX(Factor=expression_4)
pline_4 = PolyLine(Vertices=merge_2, Closed=True)
revsrf = Revolution(Curve=pline_4, Axis=Line((0, 0, 0), (126.6872814, 0, 0)), Domain=Domain(0, 6.283185307))
move_4 = Move(Geometry=revsrf, Motion=X_6)  # -> Geometry, Transform
draad = Brep(move_3.Geometry)
sint = SolidIntersection(BrepsA=draad, BrepsB=move_4.Geometry)
sint_2 = SolidIntersection(BrepsA=draad, BrepsB=revsrf)
sint_3 = SolidIntersection(BrepsA=sint_2, BrepsB=move_4.Geometry)

external_male_solid = Brep(move_3.Geometry)
external_male_surface = Brep(external_male.Breps)
external_male_with_chamfered_start = Brep(sint_2)
external_male_with_chamfered_end = Brep(sint)
external_male_chamfered = Brep(sint_3)
internal_cylinder = Brep(cap)
external_cylinder = Brep(cap_2)
