# Grasshopper definition XtrusionTest.gh (Grasshopper 1.0.4)
# Copyright: CreativeCommons ShareALikeNotComercial
# plug-ins: Pufferfish, KUKA|prc - parametric robot control, Kangaroo2 Components

# ---- group: PrintPlatform
panel = Panel("""2404.42
-359.93
667.54""")
panel_2 = Panel("""2246.5
-375.65
667.78""")
num2pt = NumbersToPoints(Numbers=panel, Mask=4)
num2pt_2 = NumbersToPoints(Numbers=panel_2, Mask=4)
panel_3 = Panel("""2246.5
294.81
675.57""")
panel_4 = Panel("""2404.42
294.81
675.57""")
num2pt_3 = NumbersToPoints(Numbers=panel_3, Mask=4)
num2pt_4 = NumbersToPoints(Numbers=panel_4, Mask=4)
srf4pt = _4PointSurface(CornerA=num2pt_2, CornerB=num2pt, CornerC=num2pt_4, CornerD=num2pt_3)

# ----
panel_5 = Panel("""302.626
4.694
83.253""")
panel_6 = Panel("""302.626
4.694
83.253""")
panel_7 = Panel("""302.626
4.694
83.253""")
num2pt_5 = NumbersToPoints(Numbers=panel_5, Mask=4)
num2pt_6 = NumbersToPoints(Numbers=panel_7, Mask=4)
num2pt_7 = NumbersToPoints(Numbers=panel_6, Mask=4)
area = Area(Geometry=srf4pt)  # -> Area, Centroid
pl_3pt = Plane3Pt(PointA=num2pt_3, PointB=num2pt_2, PointC=num2pt_4)
deplane = DeconstructPlane(Plane=pl_3pt)  # -> Origin, XAxis, YAxis, ZAxis
pl = ConstructPlane(Origin=area.Centroid, XAxis=deplane.XAxis, YAxis=deplane.YAxis)
cyl = Cylinder(Base=PlaneXY(0, 0, 0), Radius=Slider(50, range=0..100), Length=Slider(100, range=0..100))
pt = ConstructPoint(XCoordinate=0, YCoordinate=0, ZCoordinate=0)

# ---- group: board
first_layer_height = Slider(4, range=0..10)
addition = Addition(A=Slider(18, range=0..100), B=first_layer_height)
Z = UnitZ(Factor=addition)

# ----
contour = Contour(Shape=cyl, Point=pt, Direction=deplane.ZAxis, Distance=Slider(1.2, range=0..10))
Z_2 = UnitZ(Factor="4")
crv = Curve(<curve referenced from the Rhino model>)

# ---- group: MOVE UP FIRST LAYER
first_layer_height_2 = Slider(1.2, range=0..10)
unit = UnitVector(Vector=deplane.ZAxis)
amp = Amplitude(Vector=unit, Amplitude=Slider(23, range=0..100))

# ----
len = Length(Curve=crv)
division = Division(A="120000", B=len)
expression = Expression(x=division, Expression="FLOOR (X)")
arrlinear = LinearArray(Geometry=crv, Direction=Z_2, Count=expression)  # -> Geometry, Transform
move = Move(Geometry=arrlinear.Geometry, Motion=Z)  # -> Geometry, Transform
move_2 = Move(Geometry=contour, Motion=amp)  # -> flatten(Geometry), Transform
curvepoint = PointOnCurve(move.Geometry, parameter=0.5)
pdecon = Deconstruct(Point=curvepoint)  # -> XComponent, YComponent, ZComponent
topoly = CurveToPolyline(Curve=move_2.Geometry, ToleranceDistance=".5", ToleranceAngle=0)  # -> flatten(Polyline), Segments
sort = SortList(Keys=pdecon.ZComponent, ValuesA=move.Geometry)  # -> Keys, ValuesA
dispatch = Dispatch(List=topoly.Polyline, DispatchPattern=[True, False])  # -> ListA, ListB
len_2 = Length(Curve=flatten(sort.ValuesA))
flip = FlipCurve(Curve=dispatch.ListA)  # -> Curve, Flag
ma = MassAddition(Input=len_2)  # -> Result, PartialResults

# ---- group: Flipping Curves
topoly_2 = CurveToPolyline(Curve=sort.ValuesA, ToleranceDistance=".5", ToleranceAngle=0)  # -> flatten(Polyline), Segments
dispatch_2 = Dispatch(List=topoly_2.Polyline, DispatchPattern=[True, False])  # -> ListA, ListB
flip_2 = FlipCurve(Curve=dispatch_2.ListA)  # -> Curve, Flag
weave = Weave(Pattern=[0, 1], Stream0=flip_2.Curve, Stream1=dispatch_2.ListB, NullGaps=False)

# ----
Z_3 = UnitZ(Factor=Slider(2.5, range=0..10))
weave_2 = Weave(Pattern=[0, 1], Stream0=flip.Curve, Stream1=dispatch.ListB, NullGaps=False)
move_3 = Move(Geometry=topoly.Polyline, Motion=Z_3)  # -> Geometry, Transform
division_2 = Division(A=ma.Result, B="1000")
panel_8 = Panel("""0
-1""")
cull_i = CullIndex(List=move_3.Geometry, Indices=panel_8, Wrap=True)
end = EndPoints(Curve=cull_i)  # -> Start, End
printing_length = Panel(division_2)
item = ListItem(List=cull_i, Index=0, Wrap=True)
Z_4 = UnitZ(Factor=Slider(1.2, range=0..10))
flip_3 = FlipCurve(Curve=cull_i, Guide=item)  # -> Curve, Flag
neg = Negative(Value=Z_4)
move_4 = Move(Geometry=flip_3.Curve, Motion=neg)  # -> Geometry, Transform
explode = Explode(Curve=move_4.Geometry, Recursive=True)  # -> Segments, flatten(Vertices)
xy = XYPlane(Origin=explode.Vertices)
lin_move = KUKAPrcLINearMovement(TargetAsPlane=xy, extaxenabled=True, interpolation="C_DIS")  # -> flatten(KUKAPrcCommand)
explode_2 = Explode(Curve=weave, Recursive=True)  # -> Segments, flatten(Vertices)
tool_axis_offset = KUKAPrcToolAxisOffset(KUKAPrcCommand=lin_move, OffsetAlongToolaxis=100, OffsetStart=True, OffsetEnd=True, OffsetSpeed="0.1")
xy_2 = XYPlane(Origin=explode_2.Vertices)
data = Data(flatten(tool_axis_offset))

# ---- group: TOOLTIP
panel_9 = Panel("""302.626
4.694
83.253""")
num2pt_8 = NumbersToPoints(Numbers=panel_9, Mask=4)

# ----
lin_move_2 = KUKAPrcLINearMovement(TargetAsPlane=xy_2, extaxenabled=True, interpolation="C_DIS")  # -> flatten(KUKAPrcCommand)

# ---- group: TOOL GEOMETRY
mesh = Mesh(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)

# ---- group: Code generation and Simulation
number_slider = Slider(1, range=0..1)
mesh_2 = Mesh([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])
mjoin = MeshJoin(Meshes=mesh)
clean = CombineClean(Meshes=mesh_2)
reset = Button()
pt_2 = Point(Point(940, 0, 147.7))
play = KUKAPrcPlay(Loop=False, FrameRate="15", Reset=reset, savedtime=0)
move2pt = MoveToPoint(Geometry=mjoin, PointA=pt_2, PointB=num2pt_8)  # -> Moved, Vector, Transform
panel_10 = Panel("XtrusionTest04")
kuka_kr150_240_2_l110_180 = KUKAKR1502402L110180(infiniterot=False)
button = Button()
custom_tool = CustomToolForKUKAPrc(
    CustomToolGeometry=mesh,
    toolid=11,
    toolvala=0,
    toolvalb=0,
    toolvalc=-30,
    toolvalx=302.626,
    toolvaly=4.694,
    toolvalz=83.253,
    valuesset=True)

# ----
tool_axis_offset_2 = KUKAPrcToolAxisOffset(KUKAPrcCommand=lin_move_2, OffsetAlongToolaxis=100, OffsetStart=True, OffsetEnd=True, OffsetSpeed="0.1")

# ---- group: Extrusion ON
panel_11 = Panel("""$OUT[17]= TRUE
WAIT SEC 3.5""")
custom_krl = KUKAPrcCustomKRL(TextAsKRL=panel_11)
ins = InsertItems(List=tool_axis_offset_2, Item=custom_krl, Indices="2", Wrap=True)

# ---- group: Extrusion OFF
panel_12 = Panel("""$OUT[17]= FALSE
WAIT SEC 1""")
custom_krl_2 = KUKAPrcCustomKRL(TextAsKRL=panel_12)
ins_2 = InsertItems(List=ins, Item=custom_krl_2, Indices="-2", Wrap=True)

# ----
kuka_prc = KUKAPrcCORE(
    SimulationSlider=number_slider,
    KUKAPrcCommands=flatten(data),
    Tool=custom_tool,
    Robot=kuka_kr150_240_2_l110_180,
    SaveToggle=button,
    Filename=panel_10,
    PRC_BaseExpose=False,
    PRC_SaveNameExpose=True,
    PRCsettings="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")  # -> RobotGeometry, AnalysisOutput
